# Dynamo graph Parameter 기입_충북선 패밀리_개별.dyn (Dynamo 2.18.1.5096)

family_types = FamilyTypes()  # nothing selected
family_types_2 = FamilyTypes("콘크리트 트라프 T400W:콘크리트 트라프 T400W")
list_create = List.Create(item0=family_types, item1=family_types_2)
all_elements_of_family_type = ElementsOfFamilyType(Family_Type=list_create)
code_block = CodeBlock { "02.A1_객체형상"; }
code_block_2 = CodeBlock { "400X500"; }
setParameterByName = Element.SetParameterByName(element=all_elements_of_family_type, parameterName=code_block, value=code_block_2)
all_elements_of_family_type_2 = ElementsOfFamilyType(Family_Type=list_create)
code_block_3 = CodeBlock { "01.A1_객체명칭"; }
code_block_4 = CodeBlock { "콘크리트 트라프 T400W"; }
setParameterByName_2 = Element.SetParameterByName(element=all_elements_of_family_type_2, parameterName=code_block_3, value=code_block_4)
family_types_3 = FamilyTypes("콘크리트 트라프 T455W(사선):콘크리트 트라프 T455W(사선)")
family_types_4 = FamilyTypes("콘크리트 트라프 T455W:콘크리트 트라프 T455W")
list_create_2 = List.Create(item0=family_types_3, item1=family_types_4)
all_elements_of_family_type_3 = ElementsOfFamilyType(Family_Type=list_create_2)
code_block_5 = CodeBlock { "콘크리트 트라프 T455W"; }
setParameterByName_3 = Element.SetParameterByName(element=all_elements_of_family_type_3, parameterName=code_block_3, value=code_block_5)
all_elements_of_family_type_4 = ElementsOfFamilyType(Family_Type=list_create_2)
code_block_6 = CodeBlock { "455X500"; }
setParameterByName_4 = Element.SetParameterByName(element=all_elements_of_family_type_4, parameterName=code_block, value=code_block_6)
family_types_5 = FamilyTypes("H-Sv:H-Sv_1900x1700")
list_create_3 = List.Create(item0=family_types_5)  # unwired: item1
all_elements_of_family_type_5 = ElementsOfFamilyType(Family_Type=list_create_3)
code_block_7 = CodeBlock { "1900X1700X1670"; }
setParameterByName_5 = Element.SetParameterByName(element=all_elements_of_family_type_5, parameterName=code_block, value=code_block_7)
family_types_6 = FamilyTypes("접속함 1회로용:접속함 1회로용")
list_create_4 = List.Create(item0=family_types_6)
all_elements_of_family_type_6 = ElementsOfFamilyType(Family_Type=list_create_4)
code_block_8 = CodeBlock { "1100X1000X1800"; }
setParameterByName_6 = Element.SetParameterByName(element=all_elements_of_family_type_6, parameterName=code_block, value=code_block_8)
all_elements_of_family_type_7 = ElementsOfFamilyType(Family_Type=list_create_3)
code_block_9 = CodeBlock { "H-Sv"; }
setParameterByName_7 = Element.SetParameterByName(element=all_elements_of_family_type_7, parameterName=code_block_3, value=code_block_9)
all_elements_of_family_type_8 = ElementsOfFamilyType(Family_Type=list_create_4)
code_block_10 = CodeBlock { "접속함 1회로용"; }
setParameterByName_8 = Element.SetParameterByName(element=all_elements_of_family_type_8, parameterName=code_block_3, value=code_block_10)
family_types_7 = FamilyTypes("콘크리트 트로프 받침대 사선(끝)---상선:콘크리트 트로프 받침대 사선(끝)---상선")
family_types_8 = FamilyTypes("콘크리트 트로프 받침대(끝)---사선:콘크리트 트로프 받침대(끝)---사선")
family_types_9 = FamilyTypes("콘크리트 트로프 받침대(중간):콘크리트 트로프 받침대(중간)")
family_types_10 = FamilyTypes("콘크리트 트로프 받침대(중간)--상선:콘크리트 트로프 받침대(중간)--상선")
list_create_5 = List.Create(item0=family_types_7, item1=family_types_8, item2=family_types_9, item3=family_types_10)
all_elements_of_family_type_9 = ElementsOfFamilyType(Family_Type=list_create_5)
code_block_11 = CodeBlock { "400X1000"; }
setParameterByName_9 = Element.SetParameterByName(element=all_elements_of_family_type_9, parameterName=code_block, value=code_block_11)
all_elements_of_family_type_10 = ElementsOfFamilyType(Family_Type=list_create_5)
code_block_12 = CodeBlock { "콘크리트 트로프 받침대"; }
setParameterByName_10 = Element.SetParameterByName(element=all_elements_of_family_type_10, parameterName=code_block_3, value=code_block_12)
family_types_11 = FamilyTypes("H-S(F):H-S(F)_1900x1400")
list_create_6 = List.Create(item0=family_types_11)
all_elements_of_family_type_11 = ElementsOfFamilyType(Family_Type=list_create_6)
code_block_13 = CodeBlock { "1900X1400X1470"; }
setParameterByName_11 = Element.SetParameterByName(element=all_elements_of_family_type_11, parameterName=code_block, value=code_block_13)
all_elements_of_family_type_12 = ElementsOfFamilyType(Family_Type=list_create_6)
code_block_14 = CodeBlock { "H-S(F)"; }
setParameterByName_12 = Element.SetParameterByName(element=all_elements_of_family_type_12, parameterName=code_block_3, value=code_block_14)
family_types_12 = FamilyTypes("H-St:H-St_1900x1400")
list_create_7 = List.Create(item0=family_types_12)
all_elements_of_family_type_13 = ElementsOfFamilyType(Family_Type=list_create_7)
code_block_15 = CodeBlock { "1900X1400X1470"; }
setParameterByName_13 = Element.SetParameterByName(element=all_elements_of_family_type_13, parameterName=code_block, value=code_block_15)
all_elements_of_family_type_14 = ElementsOfFamilyType(Family_Type=list_create_7)
code_block_16 = CodeBlock { "H-St"; }
setParameterByName_14 = Element.SetParameterByName(element=all_elements_of_family_type_14, parameterName=code_block_3, value=code_block_16)
family_types_13 = FamilyTypes("D0C040002_터널내 탈출구 표시표지판(일반용):D0C040002_터널내 탈출구 표시표지판(일반용)")
list_create_8 = List.Create(item0=family_types_13)
all_elements_of_family_type_15 = ElementsOfFamilyType(Family_Type=list_create_8)
code_block_17 = CodeBlock { "터널내 탈출구 표시표지판"; }
setParameterByName_15 = Element.SetParameterByName(element=all_elements_of_family_type_15, parameterName=code_block_3, value=code_block_17)
all_elements_of_family_type_16 = ElementsOfFamilyType(Family_Type=list_create_8)
code_block_18 = CodeBlock { "800X400"; }
setParameterByName_16 = Element.SetParameterByName(element=all_elements_of_family_type_16, parameterName=code_block, value=code_block_18)
all_elements_of_family_type_17 = ElementsOfFamilyType()  # unwired: Family_Type
code_block_19 = CodeBlock { "850X110X130"; }
setParameterByName_17 = Element.SetParameterByName(element=all_elements_of_family_type_17, parameterName=code_block, value=code_block_19)
family_types_14 = FamilyTypes("D0C040101_터널등기구 상세도_(방진방습등 LED 16W (일반):D0C040101_터널등기구 상세도_(방진방습등 LED 16W (일반)")
list_create_9 = List.Create(item0=family_types_14)
all_elements_of_family_type_18 = ElementsOfFamilyType(Family_Type=list_create_9)
code_block_20 = CodeBlock { "터널등기구"; }
setParameterByName_18 = Element.SetParameterByName(element=all_elements_of_family_type_18, parameterName=code_block_3, value=code_block_20)
family_types_15 = FamilyTypes("터널 조명 제어시스템 TYPE A:터널 조명 제어시스템 TYPE A")
list_create_10 = List.Create(item0=family_types_15)
all_elements_of_family_type_19 = ElementsOfFamilyType(Family_Type=list_create_10)
code_block_21 = CodeBlock { "터널 조명 제어시스템 TYPE A"; }
setParameterByName_19 = Element.SetParameterByName(element=all_elements_of_family_type_19, parameterName=code_block_3, value=code_block_21)
all_elements_of_family_type_20 = ElementsOfFamilyType(Family_Type=list_create_10)
code_block_22 = CodeBlock { "900x150x700"; }
setParameterByName_20 = Element.SetParameterByName(element=all_elements_of_family_type_20, parameterName=code_block, value=code_block_22)
family_types_16 = FamilyTypes("터널 조명 제어시스템 TYPE B:터널 조명 제어시스템 TYPE B")
list_create_11 = List.Create(item0=family_types_16)
all_elements_of_family_type_21 = ElementsOfFamilyType(Family_Type=list_create_11)
code_block_23 = CodeBlock { "터널 조명 제어시스템 TYPE B"; }
setParameterByName_21 = Element.SetParameterByName(element=all_elements_of_family_type_21, parameterName=code_block_3, value=code_block_23)
all_elements_of_family_type_22 = ElementsOfFamilyType(Family_Type=list_create_11)
code_block_24 = CodeBlock { "900x150x700"; }
setParameterByName_22 = Element.SetParameterByName(element=all_elements_of_family_type_22, parameterName=code_block, value=code_block_24)
family_types_17 = FamilyTypes("터널 조명 제어시스템 TYPE C:터널 조명 제어시스템 TYPE C")
list_create_12 = List.Create(item0=family_types_17)
all_elements_of_family_type_23 = ElementsOfFamilyType(Family_Type=list_create_12)
code_block_25 = CodeBlock { "터널 조명 제어시스템 TYPE C"; }
setParameterByName_23 = Element.SetParameterByName(element=all_elements_of_family_type_23, parameterName=code_block_3, value=code_block_25)
all_elements_of_family_type_24 = ElementsOfFamilyType(Family_Type=list_create_12)
code_block_26 = CodeBlock { "900x150x700"; }
setParameterByName_24 = Element.SetParameterByName(element=all_elements_of_family_type_24, parameterName=code_block, value=code_block_26)
family_types_18 = FamilyTypes("옥외변압기반:옥외변압기반")
list_create_13 = List.Create(item0=family_types_18)
all_elements_of_family_type_25 = ElementsOfFamilyType(Family_Type=list_create_13)
code_block_27 = CodeBlock { "옥외변압기반"; }
setParameterByName_25 = Element.SetParameterByName(element=all_elements_of_family_type_25, parameterName=code_block_3, value=code_block_27)
all_elements_of_family_type_26 = ElementsOfFamilyType(Family_Type=list_create_13)
code_block_28 = CodeBlock { "5850x2800X1950"; }
setParameterByName_26 = Element.SetParameterByName(element=all_elements_of_family_type_26, parameterName=code_block, value=code_block_28)
family_types_19 = FamilyTypes("전력_토목관련전기설비_핸드홀_일반철도_H-Ht:전력_토목관련전기설비_핸드홀_일반철도_H-Ht")
list_create_14 = List.Create(item0=family_types_19)
all_elements_of_family_type_27 = ElementsOfFamilyType(Family_Type=list_create_14)
code_block_29 = CodeBlock { "H-Ht"; }
setParameterByName_27 = Element.SetParameterByName(element=all_elements_of_family_type_27, parameterName=code_block_3, value=code_block_29)
all_elements_of_family_type_28 = ElementsOfFamilyType(Family_Type=list_create_14)
code_block_30 = CodeBlock { "2600x1500X1450"; }
setParameterByName_28 = Element.SetParameterByName(element=all_elements_of_family_type_28, parameterName=code_block, value=code_block_30)
categories = Categories("OST_CableTray")
categories_2 = Categories("OST_CableTrayFitting")
list_create_15 = List.Create(item0=categories, item1=categories_2)
all_elements_of_category = ElementsOfCategory(Category=list_create_15)
code_block_31 = CodeBlock { "케이블 트레이"; }
setParameterByName_29 = Element.SetParameterByName(element=all_elements_of_category, parameterName=code_block_3, value=code_block_31)
code_block_32 = CodeBlock { "300x100"; }
setParameterByName_30 = Element.SetParameterByName(element=all_elements_of_category, parameterName=code_block, value=code_block_32)
categories_3 = Categories("OST_Conduit")
list_create_16 = List.Create(item0=categories_3)
all_elements_of_category_2 = ElementsOfCategory(Category=list_create_16)
code_block_33 = CodeBlock { "Conduit_PE"; }
setParameterByName_31 = Element.SetParameterByName(element=all_elements_of_category_2, parameterName=code_block_3, value=code_block_33)
code_block_34 = CodeBlock { "54C"; }
setParameterByName_32 = Element.SetParameterByName(element=all_elements_of_category_2, parameterName=code_block, value=code_block_34)
family_types_20 = FamilyTypes("H-Sv:H-Sv_1900x1900")
list_create_17 = List.Create(item0=family_types_20)  # unwired: item1
all_elements_of_family_type_29 = ElementsOfFamilyType(Family_Type=list_create_17)
code_block_35 = CodeBlock { "H-Sv"; }
setParameterByName_33 = Element.SetParameterByName(element=all_elements_of_family_type_29, parameterName=code_block_3, value=code_block_35)
all_elements_of_family_type_30 = ElementsOfFamilyType(Family_Type=list_create_17)
code_block_36 = CodeBlock { "1900X1900X1670"; }
setParameterByName_34 = Element.SetParameterByName(element=all_elements_of_family_type_30, parameterName=code_block, value=code_block_36)
family_types_21 = FamilyTypes("H-S(F):H-S(F)_1900x1900")
list_create_18 = List.Create(item0=family_types_21)
all_elements_of_family_type_31 = ElementsOfFamilyType(Family_Type=list_create_18)
code_block_37 = CodeBlock { "H-S(F)"; }
setParameterByName_35 = Element.SetParameterByName(element=all_elements_of_family_type_31, parameterName=code_block_3, value=code_block_37)
all_elements_of_family_type_32 = ElementsOfFamilyType(Family_Type=list_create_18)
code_block_38 = CodeBlock { "1900X1400X1470"; }
setParameterByName_36 = Element.SetParameterByName(element=all_elements_of_family_type_32, parameterName=code_block, value=code_block_38)
family_types_22 = FamilyTypes("H-S(F):H-S(F)_1900x1700")
list_create_19 = List.Create(item0=family_types_22)
all_elements_of_family_type_33 = ElementsOfFamilyType(Family_Type=list_create_19)
code_block_39 = CodeBlock { "H-S(F)"; }
setParameterByName_37 = Element.SetParameterByName(element=all_elements_of_family_type_33, parameterName=code_block_3, value=code_block_39)
all_elements_of_family_type_34 = ElementsOfFamilyType(Family_Type=list_create_19)
code_block_40 = CodeBlock { "1900X1700X1470"; }
setParameterByName_38 = Element.SetParameterByName(element=all_elements_of_family_type_34, parameterName=code_block, value=code_block_40)
family_types_23 = FamilyTypes("H-St:H-St_1900x1700")
list_create_20 = List.Create(item0=family_types_23)
all_elements_of_family_type_35 = ElementsOfFamilyType(Family_Type=list_create_20)
code_block_41 = CodeBlock { "1900X1700X1470"; }
setParameterByName_39 = Element.SetParameterByName(element=all_elements_of_family_type_35, parameterName=code_block, value=code_block_41)
all_elements_of_family_type_36 = ElementsOfFamilyType(Family_Type=list_create_20)
code_block_42 = CodeBlock { "H-St"; }
setParameterByName_40 = Element.SetParameterByName(element=all_elements_of_family_type_36, parameterName=code_block_3, value=code_block_42)
family_types_24 = FamilyTypes("H-St:H-St_1900x1400")
list_create_21 = List.Create(item0=family_types_24)
all_elements_of_family_type_37 = ElementsOfFamilyType(Family_Type=list_create_21)
code_block_43 = CodeBlock { "1900X1400X1470"; }
setParameterByName_41 = Element.SetParameterByName(element=all_elements_of_family_type_37, parameterName=code_block, value=code_block_43)
all_elements_of_family_type_38 = ElementsOfFamilyType(Family_Type=list_create_21)
code_block_44 = CodeBlock { "H-St"; }
setParameterByName_42 = Element.SetParameterByName(element=all_elements_of_family_type_38, parameterName=code_block_3, value=code_block_44)
