# Dynamo graph Parameter 기입_충북선 패밀리_개별_단순화.backup_20260331_170810.dyn "Parameter 기입_충북선 패밀리_개별_단순화" (Dynamo 2.18.1.5096)
# Simplified graph generated from the repeated family/category parameter blocks.

family_types = FamilyTypes("콘크리트 트라프 T400W:콘크리트 트라프 T400W")
family_types_2 = FamilyTypes("콘크리트 트라프 T455W(사선):콘크리트 트라프 T455W(사선)")
family_types_3 = FamilyTypes("콘크리트 트라프 T455W:콘크리트 트라프 T455W")
list_create = List.Create(item0=family_types_2, item1=family_types_3)
family_types_4 = FamilyTypes("H-Sv:H-Sv_1900x1700")
family_types_5 = FamilyTypes("접속함 1회로용:접속함 1회로용")
family_types_6 = FamilyTypes("콘크리트 트로프 받침대 사선(끝)---상선:콘크리트 트로프 받침대 사선(끝)---상선")
family_types_7 = FamilyTypes("콘크리트 트로프 받침대(끝)---사선:콘크리트 트로프 받침대(끝)---사선")
family_types_8 = FamilyTypes("콘크리트 트로프 받침대(중간):콘크리트 트로프 받침대(중간)")
family_types_9 = FamilyTypes("콘크리트 트로프 받침대(중간)--상선:콘크리트 트로프 받침대(중간)--상선")
list_create_2 = List.Create(item0=family_types_6, item1=family_types_7, item2=family_types_8, item3=family_types_9)
family_types_10 = FamilyTypes("H-S(F):H-S(F)_1900x1400")
family_types_11 = FamilyTypes("H-St:H-St_1900x1400")
family_types_12 = FamilyTypes("D0C040002_터널내 탈출구 표시표지판(일반용):D0C040002_터널내 탈출구 표시표지판(일반용)")
family_types_13 = FamilyTypes("D0C040101_터널등기구 상세도_(방진방습등 LED 16W (일반):D0C040101_터널등기구 상세도_(방진방습등 LED 16W (일반)")
family_types_14 = FamilyTypes("터널 조명 제어시스템 TYPE A:터널 조명 제어시스템 TYPE A")
family_types_15 = FamilyTypes("터널 조명 제어시스템 TYPE B:터널 조명 제어시스템 TYPE B")
family_types_16 = FamilyTypes("터널 조명 제어시스템 TYPE C:터널 조명 제어시스템 TYPE C")
family_types_17 = FamilyTypes("옥외변압기반:옥외변압기반")
family_types_18 = FamilyTypes("전력_토목관련전기설비_핸드홀_일반철도_H-Ht:전력_토목관련전기설비_핸드홀_일반철도_H-Ht")
family_types_19 = FamilyTypes("H-Sv:H-Sv_1900x1900")
family_types_20 = FamilyTypes("H-S(F):H-S(F)_1900x1900")
family_types_21 = FamilyTypes("H-S(F):H-S(F)_1900x1700")
family_types_22 = FamilyTypes("H-St:H-St_1900x1700")
list_create_3 = List.Create(item0=family_types, item1=list_create, item2=family_types_4, item3=family_types_5, item4=list_create_2, item5=family_types_10, item6=family_types_11, item7=family_types_12, item8=family_types_13, item9=family_types_14, item10=family_types_15, item11=family_types_16, item12=family_types_17, item13=family_types_18, item14=family_types_19, item15=family_types_20, item16=family_types_21, item17=family_types_22)
all_elements_of_family_type = ElementsOfFamilyType(Family_Type=list_create_3)
code_block = CodeBlock()
# ---------- code_block.designscript (1 lines) ----------
{{"02.A1_객체형상"}, {"01.A1_객체명칭"}, {"01.A1_객체명칭"}, {"02.A1_객체형상"}, {"02.A1_객체형상"}, {"01.A1_객체명칭"}, {"02.A1_객체형상"}, {"01.A1_객체명칭"}, {"02.A1_객체형상"}, {"01.A1_객체명칭"}, {"02.A1_객체형상"}, {"01.A1_객체명칭"}, {"02.A1_객체형상"}, {"01.A1_객체명칭"}, {"01.A1_객체명칭"}, {"02.A1_객체형상"}, {"01.A1_객체명칭"}, {"01.A1_객체명칭"}, {"02.A1_객체형상"}, {"01.A1_객체명칭"}, {"02.A1_객체형상"}, {"01.A1_객체명칭"}, {"02.A1_객체형상"}, {"01.A1_객체명칭"}, {"02.A1_객체형상"}, {"01.A1_객체명칭"}, {"02.A1_객체형상"}, {"01.A1_객체명칭"}, {"02.A1_객체형상"}, {"01.A1_객체명칭"}, {"02.A1_객체형상"}, {"01.A1_객체명칭"}, {"02.A1_객체형상"}, {"02.A1_객체형상"}, {"01.A1_객체명칭"}};
# ----------------------------------------
code_block_2 = CodeBlock()
# ---------- code_block_2.designscript (1 lines) ----------
{{"400X500"}, {"콘크리트 트라프 T400W"}, {"콘크리트 트라프 T455W"}, {"455X500"}, {"1900X1700X1670"}, {"H-Sv"}, {"1100X1000X1800"}, {"접속함 1회로용"}, {"400X1000"}, {"콘크리트 트로프 받침대"}, {"1900X1400X1470"}, {"H-S(F)"}, {"1900X1400X1470"}, {"H-St"}, {"터널내 탈출구 표시표지판"}, {"800X400"}, {"터널등기구"}, {"터널 조명 제어시스템 TYPE A"}, {"900x150x700"}, {"터널 조명 제어시스템 TYPE B"}, {"900x150x700"}, {"터널 조명 제어시스템 TYPE C"}, {"900x150x700"}, {"옥외변압기반"}, {"5850x2800X1950"}, {"H-Ht"}, {"2600x1500X1450"}, {"H-Sv"}, {"1900X1900X1670"}, {"H-S(F)"}, {"1900X1400X1470"}, {"H-S(F)"}, {"1900X1700X1470"}, {"1900X1700X1470"}, {"H-St"}};
# ----------------------------------------
setParameterByName = Element.SetParameterByName(element=all_elements_of_family_type, parameterName=code_block, value=code_block_2)
categories = Categories("OST_CableTray")
categories_2 = Categories("OST_CableTrayFitting")
list_create_4 = List.Create(item0=categories, item1=categories_2)
categories_3 = Categories("OST_Conduit")
list_create_5 = List.Create(item0=list_create_4, item1=categories_3)
all_elements_of_category = ElementsOfCategory(Category=list_create_5)
code_block_3 = CodeBlock { {{"01.A1_객체명칭"}, {"02.A1_객체형상"}, {"01.A1_객체명칭"}, {"02.A1_객체형상"}}; }
code_block_4 = CodeBlock { {{"케이블 트레이"}, {"300x100"}, {"Conduit_PE"}, {"54C"}}; }
setParameterByName_2 = Element.SetParameterByName(element=all_elements_of_category, parameterName=code_block_3, value=code_block_4)
