# Dynamo graph Parameter 기입_충북선_건축전기.dyn (Dynamo 2.18.1.5096)

categories = Categories("OST_CableTrayFitting")
categories_2 = Categories("OST_CableTray")
categories_3 = Categories("OST_LightingFixtures")
categories_4 = Categories("OST_ElectricalEquipment")
categories_5 = Categories("OST_ElectricalFixtures")
categories_6 = Categories("OST_Conduit")
categories_7 = Categories("OST_ConduitFitting")
list_create = List.Create(item0=categories, item1=categories_2, item2=categories_3, item3=categories_4, item4=categories_5, item5=categories_6, item6=categories_7)
all_elements_of_category = ElementsOfCategory(Category=list_create)
flatten = List.Flatten(list=all_elements_of_category)
code_block = CodeBlock { "03.A1_객체재료"; }
code_block_2 = CodeBlock { "04.A2_객체관리기관"; }
code_block_3 = CodeBlock { "05.A2_객체저작자"; }
code_block_4 = CodeBlock { "06.A2_납품일자"; }
code_block_5 = CodeBlock { "07.A2_개정일자"; }
code_block_6 = CodeBlock { "08.A2_객체버전"; }
code_block_7 = CodeBlock { "09.A3_Level1"; }
code_block_8 = CodeBlock { "10.A3_Level2"; }
code_block_9 = CodeBlock { "11.A3_Level3"; }
code_block_10 = CodeBlock { "12.A3_Level4"; }
code_block_11 = CodeBlock { "13.A3_Level5"; }
code_block_12 = CodeBlock { "14.A3_Level6"; }
code_block_13 = CodeBlock { "15.A3_Level7"; }
code_block_14 = CodeBlock { "16.A3_Level8"; }
code_block_15 = CodeBlock { "17.A3_WBS Code"; }
code_block_16 = CodeBlock { "18.A4_기준점"; }
code_block_17 = CodeBlock { "19.A4_구조물 위치"; }
code_block_18 = CodeBlock { "20.A5_계획공정시작일"; }
code_block_19 = CodeBlock { "21.A5_계획공정종료일"; }
code_block_20 = CodeBlock { "22.A5_실시공정시작일"; }
code_block_21 = CodeBlock { "23.A5_실시공정종료일"; }
code_block_22 = CodeBlock { "24.A6_시방서(링크) 및 기타"; }
code_block_23 = CodeBlock { "25.A6_설비 상세제원"; }
parameter_names = List.Create(item0=code_block, item1=code_block_2, item2=code_block_3, item3=code_block_4, item4=code_block_5, item5=code_block_6, item6=code_block_7, item7=code_block_8, item8=code_block_9, item9=code_block_10, item10=code_block_11, item11=code_block_12, item12=code_block_13, item13=code_block_14, item14=code_block_15, item15=code_block_16, item16=code_block_17, item17=code_block_18, item18=code_block_19, item19=code_block_20, item20=code_block_21, item21=code_block_22, item22=code_block_23)
code_block_24 = CodeBlock { "-"; }
code_block_25 = CodeBlock { "국가철도공단"; }
code_block_26 = CodeBlock { "협우지여엔지니어링"; }
code_block_27 = CodeBlock { "YYYY.MM.DD"; }
code_block_28 = CodeBlock { "YYYY.MM.DD"; }
code_block_29 = CodeBlock { "Revit2024"; }
code_block_30 = CodeBlock { "C"; }
code_block_31 = CodeBlock { "41"; }
code_block_32 = CodeBlock { "415"; }
code_block_33 = CodeBlock { "415C01"; }
code_block_34 = CodeBlock { "415C01A"; }
code_block_35 = CodeBlock { "415C01A2"; }
code_block_36 = CodeBlock()
# ---------- code_block_36.designscript (7 lines) ----------
"OST_ElectricalFixtures;
\nOST_LightingFixtures=415C01A2003;
\nOST_ElectricalEquipment=415C01A2001;
\nOST_CableTrayFitting=415C01A2003;
\nOST_CableTray=415C01A2003;
\nOST_Conduit;
\nOST_ConduitFitting";
# ----------------------------------------
code_block_37 = CodeBlock()
# ---------- code_block_37.designscript (7 lines) ----------
"OST_ElectricalFixtures;
\nOST_LightingFixtures=0320;
\nOST_ElectricalEquipment=0305;
\nOST_CableTrayFitting=0318;
\nOST_CableTray=0318;
\nOST_Conduit;
\nOST_ConduitFitting";
# ----------------------------------------
code_block_38 = CodeBlock { "413C01A20010200"; }
code_block_39 = CodeBlock { "조기(환) 28km 114.03"; }
code_block_40 = CodeBlock { "-"; }
code_block_41 = CodeBlock { "YYYY.MM.DD"; }
code_block_42 = CodeBlock { "YYYY.MM.DD"; }
code_block_43 = CodeBlock { "YYYY.MM.DD"; }
code_block_44 = CodeBlock { "YYYY.MM.DD"; }
code_block_45 = CodeBlock { "-"; }
code_block_46 = CodeBlock { "-"; }
parameter_values = List.Create(item0=code_block_24, item1=code_block_25, item2=code_block_26, item3=code_block_27, item4=code_block_28, item5=code_block_29, item6=code_block_30, item7=code_block_31, item8=code_block_32, item9=code_block_33, item10=code_block_34, item11=code_block_35, item12=code_block_36, item13=code_block_37, item14=code_block_38, item15=code_block_39, item16=code_block_40, item17=code_block_41, item18=code_block_42, item19=code_block_43, item20=code_block_44, item21=code_block_45, item22=code_block_46)
run_03_a1_객체재료 = BoolSelector(true)
run_04_a2_객체관리기관 = BoolSelector(true)
run_05_a2_객체저작자 = BoolSelector(true)
run_06_a2_납품일자 = BoolSelector(true)
run_07_a2_개정일자 = BoolSelector(true)
run_08_a2_객체버전 = BoolSelector(true)
run_09_a3_level1 = BoolSelector(true)
run_10_a3_level2 = BoolSelector(true)
run_11_a3_level3 = BoolSelector(true)
run_12_a3_level4 = BoolSelector(true)
run_13_a3_level5 = BoolSelector(true)
run_14_a3_level6 = BoolSelector(true)
run_15_a3_level7 = BoolSelector(true)
run_16_a3_level8 = BoolSelector(true)
run_17_a3_wbs_code = BoolSelector(true)
run_18_a4_기준점 = BoolSelector(true)
run_19_a4_구조물_위치 = BoolSelector(true)
run_20_a5_계획공정시작일 = BoolSelector(true)
run_21_a5_계획공정종료일 = BoolSelector(true)
run_22_a5_실시공정시작일 = BoolSelector(true)
run_23_a5_실시공정종료일 = BoolSelector(true)
run_24_a6_시방서_링크_및_기타 = BoolSelector(true)
run_25_a6_설비_상세제원 = BoolSelector(true)
apply_toggles = List.Create(item0=run_03_a1_객체재료, item1=run_04_a2_객체관리기관, item2=run_05_a2_객체저작자, item3=run_06_a2_납품일자, item4=run_07_a2_개정일자, item5=run_08_a2_객체버전, item6=run_09_a3_level1, item7=run_10_a3_level2, item8=run_11_a3_level3, item9=run_12_a3_level4, item10=run_13_a3_level5, item11=run_14_a3_level6, item12=run_15_a3_level7, item13=run_16_a3_level8, item14=run_17_a3_wbs_code, item15=run_18_a4_기준점, item16=run_19_a4_구조물_위치, item17=run_20_a5_계획공정시작일, item18=run_21_a5_계획공정종료일, item19=run_22_a5_실시공정시작일, item20=run_23_a5_실시공정종료일, item21=run_24_a6_시방서_링크_및_기타, item22=run_25_a6_설비_상세제원)
code_block_47 = CodeBlock { "OST_ElectricalFixtures family rules"; }
code_block_48 = CodeBlock { "OST_LightingFixtures family rules"; }
electricalequipment_family = CodeBlock { "STR PNL,TR PNL =0303; 원제설비=0312"; }  # "ElectricalEquipment family_PARAMETER VALUE"
code_block_49 = CodeBlock { "OST_CableTrayFitting family rules"; }
code_block_50 = CodeBlock { "OST_CableTray family rules"; }
code_block_51 = CodeBlock { "OST_Conduit family rules"; }
code_block_52 = CodeBlock { "OST_ConduitFitting family rules"; }
create_list = List.Create(item0=code_block_47, item1=code_block_48, item2=electricalequipment_family, item3=code_block_49, item4=code_block_50, item5=code_block_51, item6=code_block_52)
apply_parameters_python = Python(IN[0]=flatten, IN[1]=parameter_names, IN[2]=parameter_values, IN[3]=apply_toggles, IN[4]=create_list)  # CPython3
# ---------- apply_parameters_python.python (6 lines) ----------
script_path = r"C:\Users\user\Desktop\codex\#Parameter 기입_충북선_건축전기\parameter_apply_with_toggles.py"
namespace = {"IN": IN}
with open(script_path, "r", encoding="utf-8") as handle:
    code = handle.read()
exec(compile(code, script_path, "exec"), namespace)
OUT = namespace.get("OUT")
# ----------------------------------------
apply_result = Watch(apply_parameters_python)
