# Dynamo graph SharedParameterValues_Export.dyn (Dynamo 2.18.1.5096)
# author: OpenAI Codex
# Export Revit shared parameter values for selected categories to Excel.

# group: 파일 생성할 폴더 경로 입력
folder_path = StringInput("C:\Users\user\Desktop\codex\다이나모\")

string = StringInput("SharedParameters")
추출할_공유_파라미터 = StringInput("")
category = Categories("OST_ElectricalEquipment")
category_2 = Categories("OST_LightingFixtures")
category_3 = Categories("OST_CableTrayFitting")
category_4 = Categories("OST_CableTray")
category_5 = Categories("OST_ElectricalFixtures")
create = List.Create(item0=category, item1=category_2, item2=category_3, item3=category_4, item4=category_5)
boolean = BoolSelector(true)

# group: Export To Excel
python_script = Python(IN[0]=folder_path, IN[1]=string, IN[2]=추출할_공유_파라미터, IN[3]=create, IN[4]=boolean)  # CPython3
# ---------- python_script.python (6 lines) ----------
script_path = r"C:\Users\user\Desktop\codex\#SharedParameterValues_Export\shared_parameter_values_export.py"
namespace = {"IN": IN}
with open(script_path, "r", encoding="utf-8") as handle:
    code = handle.read()
exec(compile(code, script_path, "exec"), namespace)
OUT = namespace.get("OUT")
# ----------------------------------------
