# Dynamo graph SharedParameterValues_Import.dyn (Dynamo 2.18.1.5096)
# author: OpenAI Codex
# Import Revit shared parameter values from Excel for selected categories.

# group: Inputs
file_path = Filename("다이나모\SharedParameterValues_SharedParameters_20260327_110337.xlsx")
string = StringInput("SharedParameters")
category = Categories("OST_ElectricalEquipment")
category_2 = Categories("OST_ElectricalFixtures")
category_3 = Categories("OST_CableTrayFitting")
create = List.Create(item0=category, item1=category_2, item2=category_3)

boolean = BoolSelector(false)

# group: Import From Excel
python_script = Python(IN[0]=file_path, IN[1]=string, IN[2]=create, IN[3]=boolean)  # CPython3
# ---------- python_script.python (6 lines) ----------
script_path = r"C:\Users\user\Desktop\codex\shared_parameter_values_import.py"
namespace = {"IN": IN}
with open(script_path, "r", encoding="utf-8") as handle:
    code = handle.read()
exec(compile(code, script_path, "exec"), namespace)
OUT = namespace.get("OUT")
# ----------------------------------------
