# Dynamo graph ifc_class_standard_by_category.dyn (Dynamo 2.18.1.5096)
# author: OpenAI Codex
# Assign IFC Class and IFC Standard values to elements by Revit category.

# group: 1. Match Each Row
# Each category must align with the IFC Class and IFC Standard at the same index. Add more ports in Dynamo if you need more rows.
category_1 = Categories("OST_CableTray")
category_2 = Categories("OST_CableTrayFitting")
category_3 = Categories("OST_ElectricalEquipment")
category_4 = Categories("OST_LightingFixtures")
category_5 = Categories("OST_Conduit")
category_6 = Categories("OST_ConduitFitting")
ifc_class_1 = StringInput("IfcCableCarrierSegment")
ifc_class_2 = StringInput("IfcCableCarrierFitting")
ifc_class_3 = StringInput("IfcBuildingElementProxy")
ifc_class_3_2 = StringInput("IfcLightFixture")
ifc_class_3_3 = StringInput("IfcCableCarrierSegment")
ifc_class_3_4 = StringInput("IfcCableCarrierSegment")
ifc_standard_1 = StringInput("CABLETRAYSEGMENT")
ifc_standard_2 = StringInput("CABLECARRIERFITTING")
ifc_standard_3 = StringInput("NOTDEFINED")
ifc_standard_3_2 = StringInput("NOTDEFINED")
ifc_standard_3_3 = StringInput("NOTDEFINED")
ifc_standard_3_4 = StringInput("NOTDEFINED")

# group: 2. Apply To Model
# Run after checking the lists. The graph writes IFC Class to the IFC export parameter and IFC Standard to IFC Predefined Type when those parameters exist.
category_list = List.Create(item0=category_1, item1=category_2, item2=category_3, item3=category_4, item4=category_5, item5=category_6)
ifc_class_list = List.Create(item0=ifc_class_1, item1=ifc_class_2, item2=ifc_class_3, item3=ifc_class_3_2, item4=ifc_class_3_3, item5=ifc_class_3_4)
ifc_standard_list = List.Create(item0=ifc_standard_1, item1=ifc_standard_2, item2=ifc_standard_3, item3=ifc_standard_3_2, item4=ifc_standard_3_3, item5=ifc_standard_3_4)
include_types = BoolSelector(true)
apply_ifc_values = Python(IN[0]=category_list, IN[1]=ifc_class_list, IN[2]=ifc_standard_list, IN[3]=include_types)  # CPython3
# ---------- apply_ifc_values.python (6 lines) ----------
script_path = r"C:\Users\user\Desktop\codex\#ifc_class_standard_by_category\\ifc_class_standard_by_category.py"
namespace = {"IN": IN}
with open(script_path, "r", encoding="utf-8") as handle:
    code = handle.read()
exec(compile(code, script_path, "exec"), namespace)
OUT = namespace.get("OUT")
# ----------------------------------------
result_watch = Watch(apply_ifc_values)
