# Dynamo graph @closest_host_face_z_move.dyn "@player_closest_host_face_z_move" (Dynamo 2.18.1.5096)
# author: OpenAI Codex
# Move selected family instances in Z so they attach to the host face with the nearest Z relative to the moving family.

# group: 1. Select Category, Families And One Import Symbol
# Choose the target category from the dropdown, then select one or more family instances in that category and exactly one Import Symbol.
토목_이동객체의_최대_간격 = CodeBlock { 3000; }
categories = Categories()  # nothing selected
재실행_버튼 = BoolSelector(true)
import_top_solid_to_family_z = Python(IN[0]=토목_이동객체의_최대_간격, IN[1]=categories, IN[2]=재실행_버튼)  # "Import Top Solid To Family Z Move Python"; CPython3
# ---------- import_top_solid_to_family_z.python (9 lines) ----------
import base64
import gzip
import io

payload = "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"
code = gzip.GzipFile(fileobj=io.BytesIO(base64.b64decode(payload))).read().decode("utf-8")
namespace = {"IN": IN}
exec(compile(code, "<embedded:@closest_host_face_z_v1.py>", "exec"), namespace)
OUT = namespace.get("OUT")
# ----------------------------------------

# group: 2. Review Result
# Check movedIds, moveDetails, skipped, and hostSummary here after the run.
watch = Watch(import_top_solid_to_family_z)
