# Dynamo graph backup_20260409_145406__최종@player_selected_face_z_attach.dyn "최종@player_selected_face_z_attach" (Dynamo 2.18.1.5096)
# author: OpenAI Codex
# Pick one Revit face, DWG face, or Revit Link face and move selected family instances in Z so their bottom attaches to that face.

# group: 1. Select Families And Pick One Face
# Select one or more family instances first. Run the graph, then pick one Revit face, DWG face, or Revit Link element/face to attach the family bottoms by Z only.
재실행_버튼 = BoolSelector(true)
import_top_solid_to_family_z = Python(IN[0]=재실행_버튼)  # "Import Top Solid To Family Z Move Python"; CPython3
# ---------- import_top_solid_to_family_z.python (9 lines) ----------
import base64
import gzip
import io

payload = "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"
code = gzip.GzipFile(fileobj=io.BytesIO(base64.b64decode(payload))).read().decode("utf-8")
namespace = {"IN": IN}
exec(compile(code, "<embedded:@selected_face_z_attach_v1.py>", "exec"), namespace)
OUT = namespace.get("OUT")
# ----------------------------------------

# group: 2. Review Result
# Check movedIds, moveDetails, skipped, and hostSummary here after the run.
watch = Watch(import_top_solid_to_family_z)
