# Dynamo graph backup_20260422_3__추출@player_selected_face_extract_model_lines.dyn "추출@player_selected_face_extract_model_lines" (Dynamo 2.18.1.5096)
# author: OpenAI Codex
# Select one or more DWG/Revit/Revit Link faces and move the selected objects in Z so each object follows the best matching picked face at its XY.

# group: 1. Select Objects And Pick Faces
# Select one or more objects first. Run the graph, then pick one or more Revit faces, DWG faces, or Revit Link faces. Each object keeps its XY and reads the best matching picked face Z at that XY.
재실행_버튼 = BoolSelector(true)
연결_y_길이_mm = DoubleInput(20000)
객체_검색_반경_mm = DoubleInput(8000)
추출_모드 = BoolSelector(true)
selected_multi_face_z_attach = Python(IN[0]=재실행_버튼, IN[1]=연결_y_길이_mm, IN[2]=객체_검색_반경_mm, IN[3]=추출_모드)  # "Selected Multi Face Z Attach Python"; CPython3
# ---------- selected_multi_face_z_attach.python (8 lines) ----------
import io

script_path = r"C:\Users\user\Desktop\codex\#객체 토목에 밀착#\@selected_multi_face_z_attach.py"
with io.open(script_path, "r", encoding="utf-8") as script_file:
    script = script_file.read()
namespace = {"IN": IN}
exec(compile(script, script_path, "exec"), namespace)
OUT = namespace.get("OUT")
# ----------------------------------------

# group: 2. Review Result
# Check movedIds, moveDetails, skipped, selectedFaceSummary, and selectedFaceSummaries here after the run.
watch = Watch(selected_multi_face_z_attach)

watch_2 = Watch(selected_multi_face_z_attach)
