# Dynamo graph import_symbol_to_modelcurve.dyn (Dynamo 2.18.1.5096)
# author: OpenAI Codex
# Extract curves from the selected Import Symbol and create ModelCurves for the primary Z group.

# group: 1. Select Import Symbol
# Select exactly one Import Symbol in Revit before running this graph. The script extracts Line, Arc, and PolyLine geometry and creates ModelCurves for the main Z group.
z_tolerance_mm = CodeBlock { 10; }
unused_legacy_toggle = BoolSelector(false)
import_symbol_to_modelcurve = Python(IN[0]=z_tolerance_mm, IN[1]=unused_legacy_toggle)  # "Import Symbol To ModelCurve Python"; CPython3
# ---------- import_symbol_to_modelcurve.python (28 lines) ----------
from pathlib import Path

script_name = "place_workplane_family_to_nearest_wall.py"
root_path = Path(r"C:\Users\user\Desktop\codex")
candidate_paths = [
    root_path / "#workplane_family_to_nearest_wall" / script_name,
    root_path / script_name,
]

script_path = None
for candidate in candidate_paths:
    if candidate.exists():
        script_path = candidate
        break

if script_path is None:
    matches = list(root_path.rglob(script_name))
    if matches:
        script_path = matches[0]

if script_path is None:
    raise FileNotFoundError("Could not find {0} under {1}".format(script_name, root_path))

namespace = {"IN": IN}
with open(str(script_path), "r", encoding="utf-8") as handle:
    code = handle.read()
exec(compile(code, str(script_path), "exec"), namespace)
OUT = namespace.get("OUT")
# ----------------------------------------

# group: 2. Review Result
# Check createdModelCurveIds, selectedGroupCurveCount, selectedGroupTopZ, and skipped messages here after the run.
watch = Watch(import_symbol_to_modelcurve)
