# Dynamo graph modelcurve_to_family_z_move.dyn (Dynamo 2.18.1.5096)
# author: OpenAI Codex
# Move selected family instances in Z using either one selected ModelCurve or the nearest ModelCurve found automatically.

# group: 1. Select Families And Optional ModelCurve
# Select one or more family instances. You may also select exactly one ModelCurve. If no ModelCurve is selected, the script searches for the nearest ModelCurve automatically, first in the active view and then in the whole document.
max_search_distance_mm = CodeBlock { 5000; }
reserved_toggle = BoolSelector(false)
modelcurve_to_family_z_move = Python(IN[0]=max_search_distance_mm, IN[1]=reserved_toggle)  # "ModelCurve To Family Z Move Python"; CPython3
# ---------- modelcurve_to_family_z_move.python (28 lines) ----------
from pathlib import Path

script_name = "move_family_to_modelcurve_z.py"
root_path = Path(r"C:\Users\user\Desktop\codex")
candidate_paths = [
    root_path / "#workplane_family_to_nearest_wall" / script_name,
    root_path / script_name,
]

script_path = None
for candidate in candidate_paths:
    if candidate.exists():
        script_path = candidate
        break

if script_path is None:
    matches = list(root_path.rglob(script_name))
    if matches:
        script_path = matches[0]

if script_path is None:
    raise FileNotFoundError("Could not find {0} under {1}".format(script_name, root_path))

namespace = {"IN": IN}
with open(str(script_path), "r", encoding="utf-8") as handle:
    code = handle.read()
exec(compile(code, str(script_path), "exec"), namespace)
OUT = namespace.get("OUT")
# ----------------------------------------

# group: 2. Review Result
# Check movedIds, moveDetails, skipped, and hostSummary here after the run.
watch = Watch(modelcurve_to_family_z_move)
