# Dynamo graph reference_host_to_family_z_move.dyn (Dynamo 2.18.1.5096)
# author: OpenAI Codex
# Move selected family instances in Z using one selected ModelCurve or ReferencePlane as the host.

# group: 1. Select Families And One Host
# Select one or more family instances and exactly one host element. The host can be a ModelCurve or a ReferencePlane. The script keeps XY as-is and moves only Z so the family bottom meets the selected host height.
max_search_distance_mm = CodeBlock { 5000; }
reserved_toggle = BoolSelector(false)
selected_host_to_family_z_move = Python(IN[0]=max_search_distance_mm, IN[1]=reserved_toggle)  # "Selected Host To Family Z Move Python"; CPython3
# ---------- selected_host_to_family_z_move.python (28 lines) ----------
from pathlib import Path

script_name = "move_family_to_selected_host_z.py"
root_path = Path(r"C:\Users\user\Desktop\codex")
candidate_paths = [
    root_path / "#workplane_family_to_nearest_wall" / script_name,
    root_path / script_name,
]

script_path = None
for candidate in candidate_paths:
    if candidate.exists():
        script_path = candidate
        break

if script_path is None:
    matches = list(root_path.rglob(script_name))
    if matches:
        script_path = matches[0]

if script_path is None:
    raise FileNotFoundError("Could not find {0} under {1}".format(script_name, root_path))

namespace = {"IN": IN}
with open(str(script_path), "r", encoding="utf-8") as handle:
    code = handle.read()
exec(compile(code, str(script_path), "exec"), namespace)
OUT = namespace.get("OUT")
# ----------------------------------------

# group: 2. Review Result
# Check movedIds, moveDetails, skipped, and hostSummary here after the run.
watch = Watch(selected_host_to_family_z_move)
