# Dynamo graph workplane_family_to_nearest_wall.dyn (Dynamo 2.18.1.5096)
# author: OpenAI Codex
# Move selected family instances to the nearest imported surface point from ImportInstance geometry.

# group: 1. Select Instances In Revit
# Select the source work-plane based family instances in Revit before running this graph. The graph uses the current Revit selection automatically.
max_search_distance_mm = CodeBlock { 3000; }
delete_sources = BoolSelector(false)
nearest_wall_placement_python = Python(IN[0]=max_search_distance_mm, IN[1]=delete_sources)  # CPython3
# ---------- nearest_wall_placement_python.python (28 lines) ----------
from pathlib import Path

script_name = "place_workplane_family_to_nearest_wall.py"
root_path = Path(r"C:\Users\user\Desktop\codex")
candidate_paths = [
    root_path / "#workplane_family_to_nearest_wall" / script_name,
    root_path / script_name,
]

script_path = None
for candidate in candidate_paths:
    if candidate.exists():
        script_path = candidate
        break

if script_path is None:
    matches = list(root_path.rglob(script_name))
    if matches:
        script_path = matches[0]

if script_path is None:
    raise FileNotFoundError("Could not find {0} under {1}".format(script_name, root_path))

namespace = {"IN": IN}
with open(str(script_path), "r", encoding="utf-8") as handle:
    code = handle.read()
exec(compile(code, str(script_path), "exec"), namespace)
OUT = namespace.get("OUT")
# ----------------------------------------

watch = Watch(nearest_wall_placement_python)
