# Dynamo graph 객체_속성정보_삭제.dyn (Dynamo 2.18.1.5096)
# author: OpenAI Codex
# Clear selected Revit parameter values from picked elements using a parameter picker.

# group: 1. Input
# Filter Text는 선택창에서 파라미터 목록을 좁혀볼 때만 씁니다. Repick Selection이 true면 실행할 때마다 객체를 다시 선택하고, 그 객체에 실제로 들어있는 파라미터 이름만 선택창에 표시됩니다.
filter_text = StringInput("")
repick_selection = BoolSelector(true)
execute = BoolSelector(false)

# group: 2. Run
# 실행하면 파라미터 선택창이 먼저 열립니다. 선택 후 Execute가 true이면 해당 값들을 비우고, false이면 선택만 저장합니다. 문자열은 공백, 숫자는 0, ElementId는 비연결 상태로 초기화됩니다.
clear_parameter_values = Python(IN[0]=filter_text, IN[1]=repick_selection, IN[2]=execute)  # CPython3
# ---------- clear_parameter_values.python (1 lines) ----------
script_path = r"C:\Users\user\Desktop\codex\#속성정보 삭제\clear_parameter_values.py"\nnamespace = {"IN": IN}\nwith open(script_path, "r", encoding="utf-8") as handle:\n    code = handle.read()\nexec(compile(code, script_path, "exec"), namespace)\nOUT = namespace.get("OUT")\n
# ----------------------------------------
result_watch = Watch(clear_parameter_values)
