# Dynamo graph 선택@lighting_fixture_required_count.dyn (Dynamo 2.18.1.5096)
# author: OpenAI Codex
# Select Room/Space elements and one Lighting Fixture instance, then calculate required fixture counts and export the results to CSV for Excel.

# group: 1. Select Rooms And One Lighting Fixture
# Revit에서 Room 또는 Space 여러 개와 기준 Lighting Fixture 인스턴스 1개를 함께 선택합니다. Room에는 조도_요구조도_lx, 조도_조명율, 조도_보수율, 조도_반사율 파라미터가 있어야 합니다.
재실행_버튼 = BoolSelector(true)
추출_경로 = StringInput("C:\Users\user\Desktop\codex\#조도계산서\exports")
lighting_fixture_required_count = Python(IN[0]=재실행_버튼, IN[1]=추출_경로)  # "Lighting Fixture Required Count Python"; CPython3
# ---------- lighting_fixture_required_count.python (8 lines) ----------
import io

script_path = r"C:\Users\user\Desktop\codex\#조도계산서\@lighting_fixture_required_count.py"
with io.open(script_path, "r", encoding="utf-8") as script_file:
    script = script_file.read()
namespace = {"IN": IN, "__file__": script_path}
exec(compile(script, script_path, "exec"), namespace)
OUT = namespace.get("OUT")
# ----------------------------------------

# group: 2. Review Result And Export
# Watch에서 각 Room의 계산 결과와 exportCsvPath를 확인합니다. 실행이 끝나면 exports 폴더에 Excel에서 바로 열 수 있는 CSV가 저장됩니다.
watch = Watch(lighting_fixture_required_count)
