# Dynamo graph 최종@player_selected_edge_z_offset_to_family.dyn (Dynamo 2.18.1.5096)
# author: OpenAI Codex
# Pick one or more edges from DWG or Revit geometry and move selected family instances in Z using the selected edge heights plus an offset.

# group: 1. Select Families And Pick Multiple Edges
# Select one or more family instances first. Run the graph, then pick one or more Civil 3D DWG or Revit edges. The script keeps XY and moves only Z using the selected edge height plus the offset value.
재실행_버튼 = BoolSelector(true)
선택_edge_높이_오프셋_mm = DoubleInput(0)
selected_edge_z_offset_to_family = Python(IN[0]=재실행_버튼, IN[1]=선택_edge_높이_오프셋_mm)  # "Selected Edge Z Offset To Family Python"; CPython3
# ---------- selected_edge_z_offset_to_family.python (8 lines) ----------
import io

script_path = r"C:\Users\user\Desktop\codex\#터널 전등 자동 배치#\@selected_edge_z_offset_to_family_v1.py"
with io.open(script_path, "r", encoding="utf-8") as script_file:
    script = script_file.read()
namespace = {"IN": IN}
exec(compile(script, script_path, "exec"), namespace)
OUT = namespace.get("OUT")
# ----------------------------------------

# group: 2. Review Result
# Check movedIds, moveDetails, skipped, and selectedEdgeCount here after the run.
watch = Watch(selected_edge_z_offset_to_family)
