# Dynamo graph final_civil3d_dwg_outer_top_single_run_proxy_and_place_safe.dyn "edge_fit_rotate_260112_nrbscurve" (Dynamo 2.18.1.5096)

# group: 배치할 패밀리 간격
number = DoubleInput(500)

# group: 패밀리 선택
family_types = FamilyTypes("콘크리트 트라프 T400W:콘크리트 트라프 T400W 테스트")

number_2 = DoubleInput(100)

# group: 0=0°, 1=90°, 2=180°
integer_slider = IntegerSlider(1, range=0..100 step 1)

boolean = BoolSelector(true)

# group: 선택한edge-패밀리 센터선 간격 Y_offset_(선택한edge와 평행)
number_3 = DoubleInput(400)

# group: 선택한edge-패밀리 센터선 간격 X_offset 값
number_4 = DoubleInput(0)

python_script = Python(IN[0]=number, IN[1]=family_types, IN[2]=number_2, IN[3]=integer_slider, IN[4]=boolean, IN[5]=number_3, IN[6]=number_4)  # IronPython2
# ---------- python_script.python (497 lines) ----------
# -*- coding: utf-8 -*-
import clr
import math

clr.AddReference("RevitServices")
clr.AddReference("RevitAPI")
clr.AddReference("RevitAPIUI")
clr.AddReference("System")

from RevitServices.Persistence import DocumentManager
from RevitServices.Transactions import TransactionManager
from Autodesk.Revit.DB import *
from Autodesk.Revit.DB.Structure import StructuralType
from Autodesk.Revit.Exceptions import OperationCanceledException
from Autodesk.Revit.UI import Selection
from System.Collections.Generic import List

doc   = DocumentManager.Instance.CurrentDBDocument
uidoc = DocumentManager.Instance.CurrentUIApplication.ActiveUIDocument
view  = doc.ActiveView

spacing_mm  = IN[0]
symbol_in   = IN[1]
tol_mm      = IN[2]
rotate_mode = IN[3]
repick      = IN[4]
off_perp_mm = IN[5]
off_par_mm  = IN[6]

spacing = float(spacing_mm) / 304.8
tol     = float(tol_mm) / 304.8
off_perp = float(off_perp_mm) / 304.8
off_par  = float(off_par_mm) / 304.8
top_z_tol = 1.0 / 304.8

symbols = UnwrapElement(symbol_in)
symbol  = symbols[0] if isinstance(symbols, list) else symbols

def dist(a, b): return a.DistanceTo(b)

def reverse_curve(c):
    try:
        rc = c.Clone()
        rc.Reverse()
        return rc
    except:
        try:
            return c.CreateReversed()
        except:
            return c

def get_element_transform(element):
    try:
        if isinstance(element, ImportInstance):
            return element.GetTotalTransform()
    except:
        pass
    try:
        return element.GetTransform()
    except:
        return Transform.Identity

def transform_xyz(transform, point):
    try:
        return transform.OfPoint(point)
    except:
        return point

def transform_curve(transform, curve):
    try:
        return curve.CreateTransformed(transform)
    except:
        return curve

def collect_curves_from_geometry(geom_obj, transform, curves_out):
    if geom_obj is None:
        return
    try:
        curve = geom_obj.AsCurve()
        if curve is not None:
            curves_out.append(transform_curve(transform, curve))
            return
    except:
        pass
    try:
        if isinstance(geom_obj, PolyLine):
            pts = list(geom_obj.GetCoordinates())
            for i in range(len(pts) - 1):
                p0 = transform_xyz(transform, pts[i])
                p1 = transform_xyz(transform, pts[i + 1])
                if p0.DistanceTo(p1) > 1e-9:
                    curves_out.append(Line.CreateBound(p0, p1))
            return
    except:
        pass
    try:
        if isinstance(geom_obj, GeometryInstance):
            inst_transform = transform.Multiply(geom_obj.Transform)
            inst_geom = geom_obj.GetInstanceGeometry()
            for g in inst_geom:
                collect_curves_from_geometry(g, inst_transform, curves_out)
            return
    except:
        pass
    try:
        if isinstance(geom_obj, GeometryElement):
            for g in geom_obj:
                collect_curves_from_geometry(g, transform, curves_out)
    except:
        pass

def get_top_curves_from_element(element):
    opts = Options()
    opts.ComputeReferences = False
    opts.IncludeNonVisibleObjects = True
    curves = []
    transform = get_element_transform(element)
    try:
        geom = element.get_Geometry(opts)
    except:
        geom = None
    if geom is None:
        return []
    for g in geom:
        collect_curves_from_geometry(g, transform, curves)
    if not curves:
        return []
    z_values = []
    for c in curves:
        try:
            pts = list(c.Tessellate())
        except:
            pts = [c.GetEndPoint(0), c.GetEndPoint(1)]
        if pts:
            z_values.append(max([p.Z for p in pts]))
    if not z_values:
        return []
    top_z = max(z_values)
    result = []
    for c in curves:
        try:
            pts = list(c.Tessellate())
        except:
            pts = [c.GetEndPoint(0), c.GetEndPoint(1)]
        if pts and abs(max([p.Z for p in pts]) - top_z) <= top_z_tol:
            result.append(c)
    return result

def run_length(run):
    return sum([c.Length for c in run]) if run else 0.0

def get_primary_top_run_from_element(element, tol):
    top_curves = get_top_curves_from_element(element)
    if not top_curves:
        return []
    runs = build_runs(top_curves, tol)
    if not runs:
        return []
    best_run = None
    best_len = None
    for run in runs:
        total = run_length(run)
        if best_len is None or total > best_len:
            best_len = total
            best_run = run
    return best_run if best_run else []

def build_runs(curves, tol):
    segs = []
    for i, c in enumerate(curves):
        segs.append({"id": i, "curve": c, "p0": c.GetEndPoint(0), "p1": c.GetEndPoint(1), "used": False})
    runs = []

    def find_conn(pt):
        for s in segs:
            if s["used"]:
                continue
            if dist(pt, s["p0"]) <= tol: return s, 0
            if dist(pt, s["p1"]) <= tol: return s, 1
        return None, None

    for s in segs:
        if s["used"]:
            continue
        run = [s]
        s["used"] = True

        end = s["p1"]
        while True:
            ns, f = find_conn(end)
            if not ns:
                break
            c = ns["curve"]
            if f == 1:
                c = reverse_curve(c)
            ns["curve"] = c
            ns["p0"] = c.GetEndPoint(0)
            ns["p1"] = c.GetEndPoint(1)
            run.append(ns)
            ns["used"] = True
            end = ns["p1"]

        start = s["p0"]
        while True:
            ns, f = find_conn(start)
            if not ns:
                break
            c = ns["curve"]
            if f == 0:
                c = reverse_curve(c)
            ns["curve"] = c
            ns["p0"] = c.GetEndPoint(0)
            ns["p1"] = c.GetEndPoint(1)
            run.insert(0, ns)
            ns["used"] = True
            start = ns["p0"]

        runs.append([r["curve"] for r in run])
    return runs

def match_runs(main_runs, side_runs):
    pairs = []
    used = set()
    for mr in main_runs:
        best = None
        best_d = None
        for i, sr in enumerate(side_runs):
            if i in used:
                continue
            d = abs(sum([c.Length for c in mr]) - sum([c.Length for c in sr]))
            if best_d is None or d < best_d:
                best_d = d
                best = i
        if best is not None:
            used.add(best)
            pairs.append((mr, side_runs[best]))
    return pairs

def get_instance_point(inst):
    try:
        loc = inst.Location
        if hasattr(loc, "Point") and loc.Point is not None:
            return loc.Point
    except:
        pass
    return XYZ.Zero

def normalize_xy(vec):
    try:
        flat = XYZ(vec.X, vec.Y, 0.0)
        if flat.GetLength() < 1e-9:
            return None
        return flat.Normalize()
    except:
        return None

def signed_angle_xy(from_vec, to_vec):
    from_n = normalize_xy(from_vec)
    to_n = normalize_xy(to_vec)
    if from_n is None or to_n is None:
        return 0.0
    dot = max(-1.0, min(1.0, from_n.DotProduct(to_n)))
    angle = math.acos(dot)
    cross_z = from_n.X * to_n.Y - from_n.Y * to_n.X
    if cross_z < 0:
        angle = -angle
    return angle

def get_instance_x_axis(inst):
    candidates = []
    try:
        candidates.append(inst.HandOrientation)
    except:
        pass
    try:
        candidates.append(inst.FacingOrientation)
    except:
        pass
    for candidate in candidates:
        normalized = normalize_xy(candidate)
        if normalized is not None:
            return normalized
    return XYZ.BasisX

def rotate_instance_zonly(inst, target_x):
    current_x = get_instance_x_axis(inst)
    target_x = normalize_xy(target_x)
    if target_x is None:
        return
    pivot = get_instance_point(inst)
    angle = signed_angle_xy(current_x, target_x)
    if abs(angle) < 1e-6:
        return
    try:
        axis = Line.CreateBound(pivot, pivot + XYZ.BasisZ)
        ElementTransformUtils.RotateElement(doc, inst.Id, axis, angle)
    except:
        pass

def average_z(run):
    vals = []
    for c in run:
        try:
            pts = list(c.Tessellate())
        except:
            pts = [c.GetEndPoint(0), c.GetEndPoint(1)]
        for p in pts:
            vals.append(p.Z)
    if not vals:
        return 0.0
    return sum(vals) / float(len(vals))

def curve_points_for_proxy(curve):
    try:
        pts = list(curve.Tessellate())
    except:
        try:
            pts = [curve.GetEndPoint(0), curve.GetEndPoint(1)]
        except:
            pts = []
    clean = []
    for p in pts:
        if not clean or clean[-1].DistanceTo(p) > 1e-6:
            clean.append(p)
    return clean

def make_selectable_model_curves(run):
    created = []
    if not run:
        return created
    z = average_z(run)
    plane = Plane.CreateByOriginAndBasis(XYZ(0, 0, z), XYZ.BasisX, XYZ.BasisY)
    skp = SketchPlane.Create(doc, plane)
    for c in run:
        pts = curve_points_for_proxy(c)
        if len(pts) < 2:
            continue
        for i in range(len(pts) - 1):
            p0 = XYZ(pts[i].X, pts[i].Y, z)
            p1 = XYZ(pts[i + 1].X, pts[i + 1].Y, z)
            if p0.DistanceTo(p1) <= 1e-6:
                continue
            try:
                mc = doc.Create.NewModelCurve(Line.CreateBound(p0, p1), skp)
                created.append(mc)
            except:
                pass
    return created

global _MAIN_ELEMENT, _SIDE_ELEMENT
try: _MAIN_ELEMENT
except: _MAIN_ELEMENT=None
try: _SIDE_ELEMENT
except: _SIDE_ELEMENT=None

if repick or _MAIN_ELEMENT is None or _SIDE_ELEMENT is None:
    try:
        main_ref = uidoc.Selection.PickObject(Selection.ObjectType.Element, "1) Pick main DWG/Revit object")
        side_ref = uidoc.Selection.PickObject(Selection.ObjectType.Element, "2) Pick side DWG/Revit object")
    except OperationCanceledException:
        OUT = []
    else:
        _MAIN_ELEMENT = doc.GetElement(main_ref.ElementId)
        _SIDE_ELEMENT = doc.GetElement(side_ref.ElementId)

if _MAIN_ELEMENT is not None and _SIDE_ELEMENT is not None:
    main_run = get_primary_top_run_from_element(_MAIN_ELEMENT, tol)
    side_run = get_primary_top_run_from_element(_SIDE_ELEMENT, tol)

    proxy_main = []
    proxy_side = []
    try:
        TransactionManager.Instance.EnsureInTransaction(doc)
        proxy_main = make_selectable_model_curves(main_run)
        proxy_side = make_selectable_model_curves(side_run)
        TransactionManager.Instance.TransactionTaskDone()
    except:
        try:
            TransactionManager.Instance.ForceCloseTransaction()
        except:
            pass

    instances = []
    if symbol is not None and spacing > 0 and main_run and side_run:
        pairs = [(main_run, side_run)]
        origin_pt = XYZ.Zero
        try:
            TransactionManager.Instance.EnsureInTransaction(doc)
            if not symbol.IsActive:
                symbol.Activate()

            for mr, sr in pairs:
                lens = [c.Length for c in mr]
                total = sum(lens)
                if total < 1e-6:
                    continue

                cum = [0.0]
                acc = 0.0
                for L in lens:
                    acc += L
                    cum.append(acc)

                def locate(d):
                    for i, L in enumerate(lens):
                        if d <= cum[i + 1] + 1e-9:
                            t = (d - cum[i]) / L if L > 1e-9 else 0.0
                            return i, max(0.0, min(1.0, t))
                    return len(lens) - 1, 1.0

                d = off_par
                if d < 0:
                    d = 0.0
                if d > total:
                    d = total

                while d <= total + 1e-9:
                    idx, t = locate(d)
                    c = mr[idx]

                    target_pt = c.Evaluate(t, True)
                    deriv = c.ComputeDerivatives(t, True)
                    tanDir = deriv.BasisX.Normalize()

                    best_pt = None
                    best_d = None
                    for sc in sr:
                        pr = sc.Project(target_pt)
                        if pr:
                            dd = pr.XYZPoint.DistanceTo(target_pt)
                            if best_d is None or dd < best_d:
                                best_d = dd
                                best_pt = pr.XYZPoint
                    if not best_pt:
                        d += spacing
                        continue

                    rawY = (best_pt - target_pt)
                    rawY = rawY - tanDir.Multiply(rawY.DotProduct(tanDir))
                    if rawY.GetLength() < 1e-6:
                        d += spacing
                        continue
                    yDir = rawY.Normalize()

                    zDir = tanDir.CrossProduct(yDir)
                    if zDir.GetLength() < 1e-9:
                        d += spacing
                        continue
                    xDir = yDir.CrossProduct(zDir)
                    if xDir.GetLength() < 1e-9:
                        d += spacing
                        continue
                    xDir = xDir.Normalize()

                    if rotate_mode == 1:
                        target_x = yDir
                    elif rotate_mode == 2:
                        target_x = xDir.Negate()
                    else:
                        target_x = xDir

                    target_pt = target_pt + (yDir * off_perp)

                    try:
                        plane = Plane.CreateByOriginAndBasis(origin_pt, XYZ.BasisX, XYZ.BasisY)
                        skp = SketchPlane.Create(doc, plane)
                        view.SketchPlane = skp

                        inst = doc.Create.NewFamilyInstance(
                            origin_pt, symbol, skp, StructuralType.NonStructural
                        )
                        current_pt = get_instance_point(inst)
                        move_vec = target_pt - current_pt
                        ElementTransformUtils.MoveElement(doc, inst.Id, move_vec)
                        doc.Regenerate()
                        rotate_instance_zonly(inst, target_x)
                        instances.append(inst)
                    except:
                        pass

                    d += spacing

            TransactionManager.Instance.TransactionTaskDone()
        except:
            try:
                TransactionManager.Instance.ForceCloseTransaction()
            except:
                pass

    OUT = {
        "proxy_main_count": len(proxy_main),
        "proxy_side_count": len(proxy_side),
        "placed_count": len(instances),
        "instances": instances
    }
elif 'OUT' not in globals():
    OUT = []
# ----------------------------------------
