# Dynamo graph select edge_fit_family_nrbscurve_dwg_transform_rotate_final.dyn "edge_fit_rotate_260112_nrbscurve" (Dynamo 2.18.1.5096)

# group: 배치할 패밀리 간격
number = DoubleInput(500)

# group: 패밀리 선택
family_types = FamilyTypes("콘크리트 트라프 T400W:콘크리트 트라프 T400W 테스트")

number_2 = DoubleInput(100)

# group: 0=0°, 1=90°, 2=180°
integer_slider = IntegerSlider(1, range=0..100 step 1)

boolean = BoolSelector(true)

# group: 선택한edge-패밀리 센터선 간격 Y_offset_(선택한edge와 평행)
number_3 = DoubleInput(400)

# group: 선택한edge-패밀리 센터선 간격 X_offset 값
number_4 = DoubleInput(0)

python_script = Python(IN[0]=number, IN[1]=family_types, IN[2]=number_2, IN[3]=integer_slider, IN[4]=boolean, IN[5]=number_3, IN[6]=number_4)  # IronPython2
# ---------- python_script.python (400 lines) ----------
# -*- coding: utf-8 -*-
import clr
import math

clr.AddReference("RevitServices")
clr.AddReference("RevitAPI")
clr.AddReference("RevitAPIUI")
clr.AddReference("System")

from RevitServices.Persistence import DocumentManager
from RevitServices.Transactions import TransactionManager
from Autodesk.Revit.DB import *
from Autodesk.Revit.DB.Structure import StructuralType
from Autodesk.Revit.Exceptions import OperationCanceledException
from Autodesk.Revit.UI import Selection
from System.Collections.Generic import List

doc   = DocumentManager.Instance.CurrentDBDocument
uidoc = DocumentManager.Instance.CurrentUIApplication.ActiveUIDocument
view  = doc.ActiveView

spacing_mm  = IN[0]
symbol_in   = IN[1]
tol_mm      = IN[2]
rotate_mode = IN[3]
repick      = IN[4]
off_perp_mm = IN[5]
off_par_mm  = IN[6]

spacing = float(spacing_mm) / 304.8
tol     = float(tol_mm) / 304.8
off_perp = float(off_perp_mm) / 304.8
off_par  = float(off_par_mm) / 304.8

symbols = UnwrapElement(symbol_in)
symbol  = symbols[0] if isinstance(symbols, list) else symbols

def dist(a, b): return a.DistanceTo(b)

def reverse_curve(c):
    try:
        rc = c.Clone()
        rc.Reverse()
        return rc
    except:
        try:
            return c.CreateReversed()
        except:
            return c

def get_element_transform(element):
    try:
        if isinstance(element, ImportInstance):
            return element.GetTotalTransform()
    except:
        pass
    try:
        return element.GetTransform()
    except:
        return Transform.Identity

def transform_xyz(transform, point):
    try:
        return transform.OfPoint(point)
    except:
        return point

def transform_curve(transform, curve):
    try:
        return curve.CreateTransformed(transform)
    except:
        return curve

def get_curve_like_geometry(reference):
    element = doc.GetElement(reference.ElementId)
    if element is None:
        return []
    transform = get_element_transform(element)
    try:
        geom = element.GetGeometryObjectFromReference(reference)
    except:
        geom = None
    if geom is None:
        return []

    curves = []
    try:
        curve = geom.AsCurve()
        if curve is not None:
            curves.append(transform_curve(transform, curve))
            return curves
    except:
        pass

    try:
        if isinstance(geom, PolyLine):
            pts = list(geom.GetCoordinates())
            for i in range(len(pts) - 1):
                p0 = transform_xyz(transform, pts[i])
                p1 = transform_xyz(transform, pts[i + 1])
                if p0.DistanceTo(p1) > 1e-9:
                    curves.append(Line.CreateBound(p0, p1))
            return curves
    except:
        pass

    try:
        if hasattr(geom, "Tessellate"):
            pts = list(geom.Tessellate())
            for i in range(len(pts) - 1):
                p0 = transform_xyz(transform, pts[i])
                p1 = transform_xyz(transform, pts[i + 1])
                if p0.DistanceTo(p1) > 1e-9:
                    curves.append(Line.CreateBound(p0, p1))
    except:
        pass
    return curves

def refs_to_curves(refs):
    curves = []
    for ref in refs:
        curves.extend(get_curve_like_geometry(ref))
    return curves

def build_runs(curves, tol):
    segs = []
    for i, c in enumerate(curves):
        segs.append({"id": i, "curve": c, "p0": c.GetEndPoint(0), "p1": c.GetEndPoint(1), "used": False})
    runs = []

    def find_conn(pt):
        for s in segs:
            if s["used"]:
                continue
            if dist(pt, s["p0"]) <= tol: return s, 0
            if dist(pt, s["p1"]) <= tol: return s, 1
        return None, None

    for s in segs:
        if s["used"]:
            continue
        run = [s]
        s["used"] = True

        end = s["p1"]
        while True:
            ns, f = find_conn(end)
            if not ns:
                break
            c = ns["curve"]
            if f == 1:
                c = reverse_curve(c)
            ns["curve"] = c
            ns["p0"] = c.GetEndPoint(0)
            ns["p1"] = c.GetEndPoint(1)
            run.append(ns)
            ns["used"] = True
            end = ns["p1"]

        start = s["p0"]
        while True:
            ns, f = find_conn(start)
            if not ns:
                break
            c = ns["curve"]
            if f == 0:
                c = reverse_curve(c)
            ns["curve"] = c
            ns["p0"] = c.GetEndPoint(0)
            ns["p1"] = c.GetEndPoint(1)
            run.insert(0, ns)
            ns["used"] = True
            start = ns["p0"]

        runs.append([r["curve"] for r in run])
    return runs

def match_runs(main_runs, side_runs):
    pairs = []
    used = set()
    for mr in main_runs:
        best = None
        best_d = None
        for i, sr in enumerate(side_runs):
            if i in used:
                continue
            d = abs(sum([c.Length for c in mr]) - sum([c.Length for c in sr]))
            if best_d is None or d < best_d:
                best_d = d
                best = i
        if best is not None:
            used.add(best)
            pairs.append((mr, side_runs[best]))
    return pairs

def get_instance_point(inst):
    try:
        loc = inst.Location
        if hasattr(loc, "Point") and loc.Point is not None:
            return loc.Point
    except:
        pass
    return XYZ.Zero

def normalize_or_none(vec):
    if vec is None:
        return None
    try:
        if vec.GetLength() < 1e-9:
            return None
        return vec.Normalize()
    except:
        return None

def signed_angle_on_axis(from_vec, to_vec, axis_vec):
    from_n = normalize_or_none(from_vec)
    to_n = normalize_or_none(to_vec)
    axis_n = normalize_or_none(axis_vec)
    if from_n is None or to_n is None or axis_n is None:
        return 0.0
    dot = max(-1.0, min(1.0, from_n.DotProduct(to_n)))
    angle = math.acos(dot)
    cross = from_n.CrossProduct(to_n)
    if axis_n.DotProduct(cross) < 0:
        angle = -angle
    return angle

def get_instance_x_axis(inst):
    candidates = []
    try:
        candidates.append(inst.HandOrientation)
    except:
        pass
    try:
        candidates.append(inst.FacingOrientation)
    except:
        pass
    for candidate in candidates:
        normalized = normalize_or_none(candidate)
        if normalized is not None:
            return normalized
    return None

def rotate_instance_to_x(inst, target_point, target_x, axis_vec):
    current_x = get_instance_x_axis(inst)
    target_x = normalize_or_none(target_x)
    axis_vec = normalize_or_none(axis_vec)
    if current_x is None or target_x is None or axis_vec is None:
        return
    angle = signed_angle_on_axis(current_x, target_x, axis_vec)
    if abs(angle) < 1e-6:
        return
    axis = Line.CreateBound(target_point, target_point + axis_vec)
    ElementTransformUtils.RotateElement(doc, inst.Id, axis, angle)

class CurvePickFilter(Selection.ISelectionFilter):
    def AllowElement(self, element):
        return True
    def AllowReference(self, reference, position):
        try:
            return len(get_curve_like_geometry(reference)) > 0
        except:
            return False

global _MAIN_REFS, _SIDE_REFS
try: _MAIN_REFS
except: _MAIN_REFS=None
try: _SIDE_REFS
except: _SIDE_REFS=None

try:
    uidoc.Selection.SetElementIds(List[ElementId]())
except:
    pass

pick_filter = CurvePickFilter()

if repick or _MAIN_REFS is None or _SIDE_REFS is None:
    try:
        main_refs = uidoc.Selection.PickObjects(
            Selection.ObjectType.PointOnElement, pick_filter, "1) Main edge pick (Revit or 3D DWG)"
        )
        side_refs = uidoc.Selection.PickObjects(
            Selection.ObjectType.PointOnElement, pick_filter, "2) Side edge pick (Revit or 3D DWG)"
        )
    except OperationCanceledException:
        OUT = []
    else:
        _MAIN_REFS = main_refs
        _SIDE_REFS = side_refs
else:
    main_refs = _MAIN_REFS
    side_refs = _SIDE_REFS

if 'main_refs' in globals() and 'side_refs' in globals() and symbol is not None and spacing > 0:
    main_runs = build_runs(refs_to_curves(main_refs), tol)
    side_runs = build_runs(refs_to_curves(side_refs), tol)
    pairs = match_runs(main_runs, side_runs)

    TransactionManager.Instance.EnsureInTransaction(doc)
    if not symbol.IsActive:
        symbol.Activate()

    instances = []
    origin_pt = XYZ.Zero

    for mr, sr in pairs:
        lens = [c.Length for c in mr]
        total = sum(lens)
        if total < 1e-6:
            continue

        cum = [0.0]
        acc = 0.0
        for L in lens:
            acc += L
            cum.append(acc)

        def locate(d):
            for i, L in enumerate(lens):
                if d <= cum[i + 1] + 1e-9:
                    t = (d - cum[i]) / L if L > 1e-9 else 0.0
                    return i, max(0.0, min(1.0, t))
            return len(lens) - 1, 1.0

        d = off_par
        if d < 0:
            d = 0.0
        if d > total:
            d = total

        while d <= total + 1e-9:
            idx, t = locate(d)
            c = mr[idx]

            target_pt = c.Evaluate(t, True)
            deriv = c.ComputeDerivatives(t, True)
            tanDir = deriv.BasisX.Normalize()

            best_pt = None
            best_d = None
            for sc in sr:
                pr = sc.Project(target_pt)
                if pr:
                    dd = pr.XYZPoint.DistanceTo(target_pt)
                    if best_d is None or dd < best_d:
                        best_d = dd
                        best_pt = pr.XYZPoint
            if not best_pt:
                d += spacing
                continue

            rawY = (best_pt - target_pt)
            rawY = rawY - tanDir.Multiply(rawY.DotProduct(tanDir))
            if rawY.GetLength() < 1e-6:
                d += spacing
                continue
            yDir = rawY.Normalize()

            zDir = tanDir.CrossProduct(yDir)
            if zDir.GetLength() < 1e-9:
                d += spacing
                continue
            zDir = zDir.Normalize()
            xDir = yDir.CrossProduct(zDir).Normalize()

            if rotate_mode == 1:
                target_x = yDir
            elif rotate_mode == 2:
                target_x = xDir.Negate()
            else:
                target_x = xDir

            basis_x = XYZ.BasisX
            basis_y = XYZ.BasisY
            target_pt = target_pt + (yDir * off_perp)

            try:
                plane = Plane.CreateByOriginAndBasis(origin_pt, basis_x, basis_y)
                skp = SketchPlane.Create(doc, plane)
                view.SketchPlane = skp

                inst = doc.Create.NewFamilyInstance(
                    origin_pt, symbol, skp, StructuralType.NonStructural
                )
                current_pt = get_instance_point(inst)
                move_vec = target_pt - current_pt
                ElementTransformUtils.MoveElement(doc, inst.Id, move_vec)
                doc.Regenerate()
                rotate_instance_to_x(inst, target_pt, target_x, zDir)
                instances.append(inst)
            except:
                pass

            d += spacing

    TransactionManager.Instance.TransactionTaskDone()
    OUT = instances
elif 'OUT' not in globals():
    OUT = []
# ----------------------------------------
