# Dynamo graph select edge_fit_family_top_face_top_edge_only.dyn "edge_fit_rotate_260112_nrbscurve" (Dynamo 2.18.1.5096)

# group: 배치할 패밀리 간격
number = DoubleInput(500)

# group: 패밀리 선택
family_types = FamilyTypes("콘크리트 트라프 T400W:콘크리트 트라프 T400W 테스트")

number_2 = DoubleInput(100)

# group: 0=0°, 1=90°, 2=180°
integer_slider = IntegerSlider(1, range=0..100 step 1)

boolean = BoolSelector(true)

# group: 선택한edge-패밀리 센터선 간격 Y_offset_(선택한edge와 평행)
number_3 = DoubleInput(400)

# group: 선택한edge-패밀리 센터선 간격 X_offset 값
number_4 = DoubleInput(0)

python_script = Python(IN[0]=number, IN[1]=family_types, IN[2]=number_2, IN[3]=integer_slider, IN[4]=boolean, IN[5]=number_3, IN[6]=number_4)  # IronPython2
# ---------- python_script.python (491 lines) ----------
# -*- coding: utf-8 -*-
import clr
import math

clr.AddReference("RevitServices")
clr.AddReference("RevitAPI")
clr.AddReference("RevitAPIUI")
clr.AddReference("System")

from RevitServices.Persistence import DocumentManager
from RevitServices.Transactions import TransactionManager
from Autodesk.Revit.DB import *
from Autodesk.Revit.DB.Structure import StructuralType
from Autodesk.Revit.Exceptions import OperationCanceledException
from Autodesk.Revit.UI import Selection
from System.Collections.Generic import List

doc   = DocumentManager.Instance.CurrentDBDocument
uidoc = DocumentManager.Instance.CurrentUIApplication.ActiveUIDocument
view  = doc.ActiveView

spacing_mm  = IN[0]
symbol_in   = IN[1]
tol_mm      = IN[2]
rotate_mode = IN[3]
repick      = IN[4]
off_perp_mm = IN[5]
off_par_mm  = IN[6]

spacing = float(spacing_mm) / 304.8
tol     = float(tol_mm) / 304.8
off_perp = float(off_perp_mm) / 304.8
off_par  = float(off_par_mm) / 304.8
top_z_tol = 1.0 / 304.8

symbols = UnwrapElement(symbol_in)
symbol  = symbols[0] if isinstance(symbols, list) else symbols

def dist(a, b): return a.DistanceTo(b)

def reverse_curve(c):
    try:
        rc = c.Clone()
        rc.Reverse()
        return rc
    except:
        try:
            return c.CreateReversed()
        except:
            return c

def get_element_transform(element):
    try:
        if isinstance(element, ImportInstance):
            return element.GetTotalTransform()
    except:
        pass
    try:
        return element.GetTransform()
    except:
        return Transform.Identity

def transform_xyz(transform, point):
    try:
        return transform.OfPoint(point)
    except:
        return point

def transform_curve(transform, curve):
    try:
        return curve.CreateTransformed(transform)
    except:
        return curve

def get_geometry_from_reference(reference):
    element = doc.GetElement(reference.ElementId)
    if element is None:
        return None, Transform.Identity, None
    transform = get_element_transform(element)
    try:
        geom = element.GetGeometryObjectFromReference(reference)
    except:
        geom = None
    return element, transform, geom

def get_curve_like_geometry(reference):
    element, transform, geom = get_geometry_from_reference(reference)
    if geom is None:
        return []
    curves = []
    try:
        curve = geom.AsCurve()
        if curve is not None:
            curves.append(transform_curve(transform, curve))
            return curves
    except:
        pass
    try:
        if isinstance(geom, PolyLine):
            pts = list(geom.GetCoordinates())
            for i in range(len(pts) - 1):
                p0 = transform_xyz(transform, pts[i])
                p1 = transform_xyz(transform, pts[i + 1])
                if p0.DistanceTo(p1) > 1e-9:
                    curves.append(Line.CreateBound(p0, p1))
            return curves
    except:
        pass
    try:
        if hasattr(geom, "Tessellate"):
            pts = list(geom.Tessellate())
            for i in range(len(pts) - 1):
                p0 = transform_xyz(transform, pts[i])
                p1 = transform_xyz(transform, pts[i + 1])
                if p0.DistanceTo(p1) > 1e-9:
                    curves.append(Line.CreateBound(p0, p1))
    except:
        pass
    return curves

def get_face_from_reference(reference):
    element, transform, geom = get_geometry_from_reference(reference)
    try:
        if isinstance(geom, Face):
            return geom, transform
    except:
        pass
    return None, Transform.Identity

def get_reference_points(reference):
    points = []
    curves = get_curve_like_geometry(reference)
    if curves:
        for curve in curves:
            try:
                points.extend(list(curve.Tessellate()))
            except:
                try:
                    points.append(curve.GetEndPoint(0))
                    points.append(curve.GetEndPoint(1))
                except:
                    pass
        return points
    face, transform = get_face_from_reference(reference)
    if face is not None:
        try:
            mesh = face.Triangulate()
            for p in mesh.Vertices:
                points.append(transform_xyz(transform, p))
        except:
            pass
    return points

def get_reference_max_z(reference):
    pts = get_reference_points(reference)
    if not pts:
        return None
    return max([p.Z for p in pts])

def refs_to_curves(refs):
    curves = []
    for ref in refs:
        curves.extend(get_curve_like_geometry(ref))
    return curves

def build_runs(curves, tol):
    segs = []
    for i, c in enumerate(curves):
        segs.append({"id": i, "curve": c, "p0": c.GetEndPoint(0), "p1": c.GetEndPoint(1), "used": False})
    runs = []

    def find_conn(pt):
        for s in segs:
            if s["used"]:
                continue
            if dist(pt, s["p0"]) <= tol: return s, 0
            if dist(pt, s["p1"]) <= tol: return s, 1
        return None, None

    for s in segs:
        if s["used"]:
            continue
        run = [s]
        s["used"] = True

        end = s["p1"]
        while True:
            ns, f = find_conn(end)
            if not ns:
                break
            c = ns["curve"]
            if f == 1:
                c = reverse_curve(c)
            ns["curve"] = c
            ns["p0"] = c.GetEndPoint(0)
            ns["p1"] = c.GetEndPoint(1)
            run.append(ns)
            ns["used"] = True
            end = ns["p1"]

        start = s["p0"]
        while True:
            ns, f = find_conn(start)
            if not ns:
                break
            c = ns["curve"]
            if f == 0:
                c = reverse_curve(c)
            ns["curve"] = c
            ns["p0"] = c.GetEndPoint(0)
            ns["p1"] = c.GetEndPoint(1)
            run.insert(0, ns)
            ns["used"] = True
            start = ns["p0"]

        runs.append([r["curve"] for r in run])
    return runs

def match_runs(main_runs, side_runs):
    pairs = []
    used = set()
    for mr in main_runs:
        best = None
        best_d = None
        for i, sr in enumerate(side_runs):
            if i in used:
                continue
            d = abs(sum([c.Length for c in mr]) - sum([c.Length for c in sr]))
            if best_d is None or d < best_d:
                best_d = d
                best = i
        if best is not None:
            used.add(best)
            pairs.append((mr, side_runs[best]))
    return pairs

def get_instance_point(inst):
    try:
        loc = inst.Location
        if hasattr(loc, "Point") and loc.Point is not None:
            return loc.Point
    except:
        pass
    return XYZ.Zero

def normalize_xy(vec):
    try:
        flat = XYZ(vec.X, vec.Y, 0.0)
        if flat.GetLength() < 1e-9:
            return None
        return flat.Normalize()
    except:
        return None

def signed_angle_xy(from_vec, to_vec):
    from_n = normalize_xy(from_vec)
    to_n = normalize_xy(to_vec)
    if from_n is None or to_n is None:
        return 0.0
    dot = max(-1.0, min(1.0, from_n.DotProduct(to_n)))
    angle = math.acos(dot)
    cross_z = from_n.X * to_n.Y - from_n.Y * to_n.X
    if cross_z < 0:
        angle = -angle
    return angle

def get_instance_x_axis(inst):
    candidates = []
    try:
        candidates.append(inst.HandOrientation)
    except:
        pass
    try:
        candidates.append(inst.FacingOrientation)
    except:
        pass
    for candidate in candidates:
        normalized = normalize_xy(candidate)
        if normalized is not None:
            return normalized
    return XYZ.BasisX

def rotate_instance_zonly(inst, target_x):
    current_x = get_instance_x_axis(inst)
    target_x = normalize_xy(target_x)
    if target_x is None:
        return
    pivot = get_instance_point(inst)
    angle = signed_angle_xy(current_x, target_x)
    if abs(angle) < 1e-6:
        return
    try:
        axis = Line.CreateBound(pivot, pivot + XYZ.BasisZ)
        ElementTransformUtils.RotateElement(doc, inst.Id, axis, angle)
    except:
        pass

class AnyPickFilter(Selection.ISelectionFilter):
    def AllowElement(self, element):
        return True
    def AllowReference(self, reference, position):
        return True

def pick_refs(message):
    return uidoc.Selection.PickObjects(
        Selection.ObjectType.PointOnElement,
        AnyPickFilter(),
        message
    )

def keep_top_face(refs):
    faces = []
    for r in refs:
        face, transform = get_face_from_reference(r)
        if face is None:
            continue
        z = get_reference_max_z(r)
        if z is None:
            continue
        faces.append((r, z))
    if not faces:
        return []
    top = max([z for _, z in faces])
    top_faces = [item for item in faces if abs(item[1] - top) <= top_z_tol]
    top_faces.sort(key=lambda item: item[1], reverse=True)
    return [top_faces[0][0]]

def keep_top_edges(refs):
    edges = []
    for r in refs:
        curves = get_curve_like_geometry(r)
        if not curves:
            continue
        z = get_reference_max_z(r)
        if z is None:
            continue
        edges.append((r, z))
    if not edges:
        return []
    top = max([z for _, z in edges])
    return [r for r, z in edges if abs(z - top) <= top_z_tol]

def get_side_point_from_face(face_ref, target_pt):
    face, transform = get_face_from_reference(face_ref)
    if face is None:
        return None
    try:
        pr = face.Project(target_pt)
        if pr is None:
            return None
        return transform_xyz(transform, pr.XYZPoint)
    except:
        return None

global _MAIN_REFS, _SIDE_REFS, _SIDE_FACE_REFS
try: _MAIN_REFS
except: _MAIN_REFS=None
try: _SIDE_REFS
except: _SIDE_REFS=None
try: _SIDE_FACE_REFS
except: _SIDE_FACE_REFS=None

try:
    uidoc.Selection.SetElementIds(List[ElementId]())
except:
    pass

if repick or _MAIN_REFS is None or _SIDE_REFS is None or _SIDE_FACE_REFS is None:
    try:
        main_raw = pick_refs("1) Pick main refs, topmost top edges only will be used")
        side_raw = pick_refs("2) Pick side refs, topmost face and top edges only will be used")
    except OperationCanceledException:
        OUT = []
    else:
        _MAIN_REFS = keep_top_edges(main_raw)
        _SIDE_REFS = keep_top_edges(side_raw)
        _SIDE_FACE_REFS = keep_top_face(side_raw)
else:
    main_raw = _MAIN_REFS
    side_raw = _SIDE_REFS

if 'main_raw' in globals() and symbol is not None and spacing > 0:
    main_runs = build_runs(refs_to_curves(_MAIN_REFS), tol)
    side_runs = build_runs(refs_to_curves(_SIDE_REFS), tol)
    pairs = match_runs(main_runs, side_runs if side_runs else [[] for _ in main_runs])

    TransactionManager.Instance.EnsureInTransaction(doc)
    if not symbol.IsActive:
        symbol.Activate()

    instances = []
    origin_pt = XYZ.Zero

    for pair_index, pair in enumerate(pairs):
        mr, sr = pair
        lens = [c.Length for c in mr]
        total = sum(lens)
        if total < 1e-6:
            continue

        cum = [0.0]
        acc = 0.0
        for L in lens:
            acc += L
            cum.append(acc)

        def locate(d):
            for i, L in enumerate(lens):
                if d <= cum[i + 1] + 1e-9:
                    t = (d - cum[i]) / L if L > 1e-9 else 0.0
                    return i, max(0.0, min(1.0, t))
            return len(lens) - 1, 1.0

        d = off_par
        if d < 0:
            d = 0.0
        if d > total:
            d = total

        while d <= total + 1e-9:
            idx, t = locate(d)
            c = mr[idx]

            target_pt = c.Evaluate(t, True)
            deriv = c.ComputeDerivatives(t, True)
            tanDir = deriv.BasisX.Normalize()

            best_pt = None
            best_d = None
            for sc in sr:
                pr = sc.Project(target_pt)
                if pr:
                    dd = pr.XYZPoint.DistanceTo(target_pt)
                    if best_d is None or dd < best_d:
                        best_d = dd
                        best_pt = pr.XYZPoint
            if best_pt is None and _SIDE_FACE_REFS:
                best_pt = get_side_point_from_face(_SIDE_FACE_REFS[0], target_pt)
            if best_pt is None:
                d += spacing
                continue

            rawY = (best_pt - target_pt)
            rawY = rawY - tanDir.Multiply(rawY.DotProduct(tanDir))
            if rawY.GetLength() < 1e-6:
                d += spacing
                continue
            yDir = rawY.Normalize()

            zDir = tanDir.CrossProduct(yDir)
            if zDir.GetLength() < 1e-9:
                d += spacing
                continue
            xDir = yDir.CrossProduct(zDir)
            if xDir.GetLength() < 1e-9:
                d += spacing
                continue
            xDir = xDir.Normalize()

            if rotate_mode == 1:
                target_x = yDir
            elif rotate_mode == 2:
                target_x = xDir.Negate()
            else:
                target_x = xDir

            target_pt = target_pt + (yDir * off_perp)

            try:
                plane = Plane.CreateByOriginAndBasis(origin_pt, XYZ.BasisX, XYZ.BasisY)
                skp = SketchPlane.Create(doc, plane)
                view.SketchPlane = skp

                inst = doc.Create.NewFamilyInstance(
                    origin_pt, symbol, skp, StructuralType.NonStructural
                )
                current_pt = get_instance_point(inst)
                move_vec = target_pt - current_pt
                ElementTransformUtils.MoveElement(doc, inst.Id, move_vec)
                doc.Regenerate()
                rotate_instance_zonly(inst, target_x)
                instances.append(inst)
            except:
                pass

            d += spacing

    OUT = instances
    TransactionManager.Instance.TransactionTaskDone()
elif 'OUT' not in globals():
    OUT = []
# ----------------------------------------
