# Dynamo graph select family_on_single_face_fixed.dyn "edge_fit_rotate_260112_nrbscurve" (Dynamo 2.18.1.5096)

# group: 배치할 패밀리 간격
number = DoubleInput(500)

# group: 패밀리 선택
family_types = FamilyTypes("콘크리트 트라프 T400W:콘크리트 트라프 T400W 테스트")

number_2 = DoubleInput(100)

# group: 0=0°, 1=90°, 2=180°
integer_slider = IntegerSlider(1, range=0..100 step 1)

boolean = BoolSelector(true)

# group: 선택한edge-패밀리 센터선 간격 Y_offset_(선택한edge와 평행)
number_3 = DoubleInput(400)

# group: 선택한edge-패밀리 센터선 간격 X_offset 값
number_4 = DoubleInput(0)

python_script = Python(IN[0]=number, IN[1]=family_types, IN[2]=number_2, IN[3]=integer_slider, IN[4]=boolean, IN[5]=number_3, IN[6]=number_4)  # IronPython2
# ---------- python_script.python (366 lines) ----------
# -*- coding: utf-8 -*-
import clr
import math

clr.AddReference("RevitServices")
clr.AddReference("RevitAPI")
clr.AddReference("RevitAPIUI")
clr.AddReference("System")

from RevitServices.Persistence import DocumentManager
from RevitServices.Transactions import TransactionManager
from Autodesk.Revit.DB import *
from Autodesk.Revit.DB.Structure import StructuralType
from Autodesk.Revit.Exceptions import OperationCanceledException
from Autodesk.Revit.UI import Selection
from System.Collections.Generic import List

doc   = DocumentManager.Instance.CurrentDBDocument
uidoc = DocumentManager.Instance.CurrentUIApplication.ActiveUIDocument
view  = doc.ActiveView

spacing_mm  = IN[0]
symbol_in   = IN[1]
tol_mm      = IN[2]
rotate_mode = IN[3]
repick      = IN[4]
off_perp_mm = IN[5]
off_par_mm  = IN[6]

spacing = float(spacing_mm) / 304.8
tol     = float(tol_mm) / 304.8
off_perp = float(off_perp_mm) / 304.8
off_par  = float(off_par_mm) / 304.8
top_z_tol = 1.0 / 304.8

symbols = UnwrapElement(symbol_in)
symbol  = symbols[0] if isinstance(symbols, list) else symbols

def dist(a, b): return a.DistanceTo(b)

def reverse_curve(c):
    try:
        rc = c.Clone()
        rc.Reverse()
        return rc
    except:
        try:
            return c.CreateReversed()
        except:
            return c

def get_element_transform(element):
    try:
        if isinstance(element, ImportInstance):
            return element.GetTotalTransform()
    except:
        pass
    try:
        return element.GetTransform()
    except:
        return Transform.Identity

def transform_xyz(transform, point):
    try:
        return transform.OfPoint(point)
    except:
        return point

def transform_vec(transform, vec):
    try:
        return transform.OfVector(vec)
    except:
        return vec

def inverse_point(transform, point):
    try:
        return transform.Inverse.OfPoint(point)
    except:
        return point

def transform_curve(transform, curve):
    try:
        return curve.CreateTransformed(transform)
    except:
        return curve

def get_face_from_reference(reference):
    element = doc.GetElement(reference.ElementId)
    if element is None:
        return None, Transform.Identity
    transform = get_element_transform(element)
    try:
        geom = element.GetGeometryObjectFromReference(reference)
    except:
        geom = None
    try:
        if isinstance(geom, Face):
            return geom, transform
    except:
        pass
    return None, Transform.Identity

def get_top_boundary_curves(face, transform):
    curves = []
    try:
        loops = face.EdgeLoops
    except:
        loops = []
    top_z = None
    candidates = []
    for loop in loops:
        for edge in loop:
            try:
                curve = transform_curve(transform, edge.AsCurve())
            except:
                curve = None
            if curve is None:
                continue
            try:
                pts = list(curve.Tessellate())
            except:
                pts = [curve.GetEndPoint(0), curve.GetEndPoint(1)]
            if not pts:
                continue
            max_z = max([p.Z for p in pts])
            candidates.append((curve, max_z))
            if top_z is None or max_z > top_z:
                top_z = max_z
    if top_z is None:
        return []
    for curve, max_z in candidates:
        if abs(max_z - top_z) <= top_z_tol:
            curves.append(curve)
    return curves

def build_runs(curves, tol):
    segs = []
    for i, c in enumerate(curves):
        segs.append({"id": i, "curve": c, "p0": c.GetEndPoint(0), "p1": c.GetEndPoint(1), "used": False})
    runs = []

    def find_conn(pt):
        for s in segs:
            if s["used"]:
                continue
            if dist(pt, s["p0"]) <= tol: return s, 0
            if dist(pt, s["p1"]) <= tol: return s, 1
        return None, None

    for s in segs:
        if s["used"]:
            continue
        run = [s]
        s["used"] = True

        end = s["p1"]
        while True:
            ns, f = find_conn(end)
            if not ns:
                break
            c = ns["curve"]
            if f == 1:
                c = reverse_curve(c)
            ns["curve"] = c
            ns["p0"] = c.GetEndPoint(0)
            ns["p1"] = c.GetEndPoint(1)
            run.append(ns)
            ns["used"] = True
            end = ns["p1"]

        start = s["p0"]
        while True:
            ns, f = find_conn(start)
            if not ns:
                break
            c = ns["curve"]
            if f == 0:
                c = reverse_curve(c)
            ns["curve"] = c
            ns["p0"] = c.GetEndPoint(0)
            ns["p1"] = c.GetEndPoint(1)
            run.insert(0, ns)
            ns["used"] = True
            start = ns["p0"]

        runs.append([r["curve"] for r in run])
    return runs

def get_instance_point(inst):
    try:
        loc = inst.Location
        if hasattr(loc, "Point") and loc.Point is not None:
            return loc.Point
    except:
        pass
    return XYZ.Zero

def normalize_or_none(vec):
    try:
        if vec is None or vec.GetLength() < 1e-9:
            return None
        return vec.Normalize()
    except:
        return None

def signed_angle_on_axis(from_vec, to_vec, axis_vec):
    from_n = normalize_or_none(from_vec)
    to_n = normalize_or_none(to_vec)
    axis_n = normalize_or_none(axis_vec)
    if from_n is None or to_n is None or axis_n is None:
        return 0.0
    dot = max(-1.0, min(1.0, from_n.DotProduct(to_n)))
    angle = math.acos(dot)
    cross = from_n.CrossProduct(to_n)
    if axis_n.DotProduct(cross) < 0:
        angle = -angle
    return angle

def get_instance_x_axis(inst):
    candidates = []
    try:
        candidates.append(inst.HandOrientation)
    except:
        pass
    try:
        candidates.append(inst.FacingOrientation)
    except:
        pass
    for c in candidates:
        n = normalize_or_none(c)
        if n is not None:
            return n
    return XYZ.BasisX

def rotate_instance_on_face(inst, target_x, axis_vec):
    current_x = get_instance_x_axis(inst)
    target_x = normalize_or_none(target_x)
    axis_vec = normalize_or_none(axis_vec)
    if current_x is None or target_x is None or axis_vec is None:
        return
    pivot = get_instance_point(inst)
    angle = signed_angle_on_axis(current_x, target_x, axis_vec)
    if abs(angle) < 1e-6:
        return
    try:
        axis = Line.CreateBound(pivot, pivot + axis_vec)
        ElementTransformUtils.RotateElement(doc, inst.Id, axis, angle)
    except:
        pass

global _FACE_REF
try: _FACE_REF
except: _FACE_REF = None

if repick or _FACE_REF is None:
    try:
        _FACE_REF = uidoc.Selection.PickObject(
            Selection.ObjectType.PointOnElement,
            "Pick one face (Revit or DWG)"
        )
    except OperationCanceledException:
        OUT = []

if _FACE_REF is not None and symbol is not None and spacing > 0:
    face, transform = get_face_from_reference(_FACE_REF)
    if face is None:
        OUT = []
    else:
        curves = get_top_boundary_curves(face, transform)
        runs = build_runs(curves, tol)

        TransactionManager.Instance.EnsureInTransaction(doc)
        if not symbol.IsActive:
            symbol.Activate()

        instances = []
        origin_pt = XYZ.Zero

        for run in runs:
            lens = [c.Length for c in run]
            total = sum(lens)
            if total < 1e-6:
                continue

            cum = [0.0]
            acc = 0.0
            for L in lens:
                acc += L
                cum.append(acc)

            def locate(d):
                for i, L in enumerate(lens):
                    if d <= cum[i + 1] + 1e-9:
                        t = (d - cum[i]) / L if L > 1e-9 else 0.0
                        return i, max(0.0, min(1.0, t))
                return len(lens) - 1, 1.0

            d = off_par
            if d < 0:
                d = 0.0
            if d > total:
                d = total

            while d <= total + 1e-9:
                idx, t = locate(d)
                curve = run[idx]
                target_pt = curve.Evaluate(t, True)
                tangent = curve.ComputeDerivatives(t, True).BasisX.Normalize()

                try:
                    local_pt = inverse_point(transform, target_pt)
                    ir = face.Project(local_pt)
                except:
                    ir = None
                if ir is None:
                    d += spacing
                    continue

                try:
                    normal = transform_vec(transform, face.ComputeNormal(ir.UVPoint)).Normalize()
                except:
                    d += spacing
                    continue

                xDir = tangent - normal.Multiply(tangent.DotProduct(normal))
                if xDir.GetLength() < 1e-9:
                    d += spacing
                    continue
                xDir = xDir.Normalize()
                yDir = normal.CrossProduct(xDir)
                if yDir.GetLength() < 1e-9:
                    d += spacing
                    continue
                yDir = yDir.Normalize()

                if rotate_mode == 1:
                    target_x = yDir
                elif rotate_mode == 2:
                    target_x = xDir.Negate()
                else:
                    target_x = xDir

                place_pt = target_pt + (yDir * off_perp)

                try:
                    plane = Plane.CreateByOriginAndBasis(origin_pt, xDir, yDir)
                    skp = SketchPlane.Create(doc, plane)
                    view.SketchPlane = skp
                    inst = doc.Create.NewFamilyInstance(
                        origin_pt, symbol, skp, StructuralType.NonStructural
                    )
                    current_pt = get_instance_point(inst)
                    move_vec = place_pt - current_pt
                    ElementTransformUtils.MoveElement(doc, inst.Id, move_vec)
                    doc.Regenerate()
                    rotate_instance_on_face(inst, target_x, normal)
                    instances.append(inst)
                except:
                    pass

                d += spacing

        OUT = instances
        TransactionManager.Instance.TransactionTaskDone()
elif 'OUT' not in globals():
    OUT = []
# ----------------------------------------
