# Dynamo graph 전기장비_패밀리추출.dyn (Dynamo 2.19.0.0)
# 전기 장비 패밀리 추출

python_script = Python(IsSetAsInput=false, IsSetAsOutput=false, ExcludeFromDynamoLibrary=false, X=200, Y=200)  # CPython3
# ---------- python_script.python (61 lines) ----------
import clr
clr.AddReference('RevitAPI')
clr.AddReference('RevitServices')
from RevitServices.Persistence import DocumentManager
from Autodesk.Revit.DB import *
import csv, os

doc = DocumentManager.Instance.CurrentDBDocument

# 전기 관련 카테고리 ID (Revit 내장)
ELEC_CATS = [
    BuiltInCategory.OST_ElectricalEquipment,
    BuiltInCategory.OST_ElectricalFixtures,
    BuiltInCategory.OST_LightingFixtures,
    BuiltInCategory.OST_LightingDevices,
    BuiltInCategory.OST_DataDevices,
    BuiltInCategory.OST_FireAlarmDevices,
    BuiltInCategory.OST_NurseCallDevices,
    BuiltInCategory.OST_SecurityDevices,
    BuiltInCategory.OST_TelephoneDevices,
    BuiltInCategory.OST_CommunicationDevices,
]

results = []
all_families = set()

for cat in ELEC_CATS:
    try:
        cat_filter = ElementCategoryFilter(cat)
        collector = FilteredElementCollector(doc).WherePasses(cat_filter).WhereElementIsNotElementType()
        for elem in collector:
            fam_inst = elem
            try:
                fam_sym = doc.GetElement(fam_inst.GetTypeId())
                if fam_sym is None:
                    continue
                fam = fam_sym.Family if hasattr(fam_sym, 'Family') else None
                fam_name = fam.Name if fam else 'Unknown'
                type_name = fam_sym.get_Parameter(BuiltInParameter.SYMBOL_NAME_PARAM)
                type_str = type_name.AsString() if type_name else 'Unknown'
                cat_name = elem.Category.Name if elem.Category else 'Unknown'
                key = (cat_name, fam_name, type_str)
                if key not in all_families:
                    all_families.add(key)
                    results.append({'카테고리': cat_name, '패밀리명': fam_name, '유형명': type_str})
            except:
                pass
    except:
        pass

results.sort(key=lambda x: (x['카테고리'], x['패밀리명'], x['유형명']))

# CSV 저장
out_dir = os.path.dirname(doc.PathName)
out_path = os.path.join(out_dir, '전기장비_패밀리목록.csv')
with open(out_path, 'w', newline='', encoding='utf-8-sig') as f:
    writer = csv.DictWriter(f, fieldnames=['카테고리','패밀리명','유형명'])
    writer.writeheader()
    writer.writerows(results)

OUT = [out_path, results]
# ----------------------------------------
code_block = CodeBlock(x=python_script, X=600, Y=200) { x[0]; }
